# Dynamo custom node Data_CurrentDate.dyf "Data.Current Date" (Dynamo 2.17.1.4055)
# category: ACG Tools
# Generates today's date in the DD.MM.YY, DD/MM/DD or YYMMDD format.

python_script = Python()  # IronPython2; unwired: IN[0]
# ---------- python_script.python (7 lines) ----------
from datetime import datetime

dd_mm_yy = datetime.now().strftime("%d.%m.%y")
dd_mm_yy_ = datetime.now().strftime("%d/%m/%y")
yymmdd = datetime.now().strftime("%y%m%d")

OUT = dd_mm_yy, dd_mm_yy_, yymmdd
# ----------------------------------------
code_block = CodeBlock(x=python_script) { x[0]; x[1]; x[2]; }
DD_MM_YY = Output(code_block.out0)  # "DD.MM.YY"
DD_MM_YY_2 = Output(code_block.out1)  # "DD/MM/YY"
YYMMDD = Output(code_block.out2)
