# Dynamo custom node Document_SyncCurrentDocument.dyf "Document.Sync Current Document" (Dynamo 2.12.1.8246)
# category: ACG Tools
# Synchronizes the current workshared Revit document with central.

run_it = Input(run_it: bool = false)  # Set to true to synchronize the current Revit document.
comment = Input(comment: string = "Synced from Dynamo")  # Synchronize with Central comment.
relinquish_all = Input(relinquish_all: bool = true)  # Relinquish all editable worksets and borrowed elements after sync.
compact = Input(compact: bool = false)  # Compact the central model during synchronization.
python_script = Python(IN[0]=run_it, IN[1]=comment, IN[2]=relinquish_all, IN[3]=compact)  # IronPython2
# ---------- python_script.python (86 lines) ----------
import clr
from datetime import datetime

clr.AddReference('RevitAPI')
from Autodesk.Revit.DB import *

clr.AddReference('RevitServices')
from RevitServices.Persistence import DocumentManager
from RevitServices.Transactions import TransactionManager


def as_bool(value, default=False):
    if value is None:
        return default
    if isinstance(value, bool):
        return value
    text = str(value).strip().lower()
    if text in ('true', '1', 'yes', 'y'):
        return True
    if text in ('false', '0', 'no', 'n', ''):
        return False
    return bool(value)


def central_path(document):
    try:
        model_path = document.GetWorksharingCentralModelPath()
        if model_path:
            return ModelPathUtils.ConvertModelPathToUserVisiblePath(model_path)
    except:
        pass
    try:
        return document.PathName
    except:
        return ''


run_it = as_bool(IN[0], False)
comment = IN[1] if IN[1] else 'Synced from Dynamo'
relinquish_all = as_bool(IN[2], True)
compact = as_bool(IN[3], False)

doc = DocumentManager.Instance.CurrentDBDocument
document_title = doc.Title if doc else ''
document_path = central_path(doc) if doc else ''
synced_at = ''
is_detached = False

if doc:
    try:
        is_detached = doc.IsDetached
    except:
        is_detached = False

success = False
message = 'Set run_it to true to synchronize the current Revit document.'

if run_it:
    if doc is None:
        message = 'No current Revit document was found.'
    elif not doc.IsWorkshared:
        message = 'The current Revit document is not workshared and cannot synchronize with central.'
    elif is_detached:
        message = 'The current Revit document is detached from central and cannot synchronize.'
    else:
        try:
            # SynchronizeWithCentral must run outside Dynamo/Revit transactions.
            TransactionManager.Instance.ForceCloseTransaction()

            transact_options = TransactWithCentralOptions()
            sync_options = SynchronizeWithCentralOptions()
            sync_options.Comment = str(comment)
            sync_options.Compact = compact
            sync_options.SaveLocalBefore = True
            sync_options.SaveLocalAfter = True
            sync_options.SetRelinquishOptions(RelinquishOptions(relinquish_all))

            doc.SynchronizeWithCentral(transact_options, sync_options)
            success = True
            synced_at = datetime.now().strftime('%Y-%m-%d %H:%M:%S')
            document_path = central_path(doc)
            message = 'Synchronized current Revit document with central.'
        except Exception as err:
            message = 'Synchronize with central failed: ' + str(err)

OUT = [success, message, document_title, document_path, synced_at]
# ----------------------------------------
code_block = CodeBlock(x=python_script) { x[0]; x[1]; x[2]; x[3]; x[4]; }
success = Output(code_block.out0)
message = Output(code_block.out1)
document_title = Output(code_block.out2)
central_path = Output(code_block.out3)
synced_at = Output(code_block.out4)
