# Dynamo custom node Elements_CompoundStructureLayers.dyf (Dynamo 2.17.1.4055)
# category: ACG Tools
# From Clockworks. Widths not working in mm

elements_type = Input(elements_type: var[]..[])

# group: Control
create = List.Create(item0=elements_type)
flatten = List.Flatten(list=create)

# group: Processing
python_script = Python(IN[0]=flatten)  # IronPython2
# ---------- python_script.python (56 lines) ----------
import clr
clr.AddReference('RevitAPI')
from Autodesk.Revit.DB import *

clr.AddReference("RevitNodes")
import Revit
clr.ImportExtensions(Revit.Elements)

items = UnwrapElement(IN[0])
elemlayers = list()
elemmat = list()
elemfunc = list()
elemwidth = list()
elemcore = list()
elemwraps = list()
elemvar = list()
elemdeck = list()

for item in items:
	try:
		counter = 0
		layers = list()
		layermat = list()
		layerfunc = list()
		layerwidth = list()
		layercore = list()
		layerwraps = list()
		layervar = list()
		layerdeck = list()
		compstruc = item.GetCompoundStructure()
		num = compstruc.LayerCount
		vertcomp = compstruc.IsVerticallyCompound
		varlayer = compstruc.VariableLayerIndex
		while counter < num:
			layers.append(compstruc.GetLayers()[counter])
			layermat.append(item.Document.GetElement(compstruc.GetMaterialId(counter)))
			layerfunc.append(compstruc.GetLayerFunction(counter))
			layerwidth.append(compstruc.GetLayerWidth(counter))
			layercore.append(compstruc.IsCoreLayer(counter))
			if compstruc.IsCoreLayer(counter): layerwraps.append(False)
			else: layerwraps.append(compstruc.ParticipatesInWrapping(counter))
			if varlayer == counter: layervar.append(True)
			else: layervar.append(False)
			layerdeck.append(compstruc.IsStructuralDeck(counter))
			counter += 1
	except:
		pass
	elemlayers.append(layers)
	elemmat.append(layermat)
	elemfunc.append(layerfunc)
	elemwidth.append(layerwidth)
	elemcore.append(layercore)
	elemwraps.append(layerwraps)
	elemvar.append(layervar)
	elemdeck.append(layerdeck)
OUT = (elemlayers, elemmat, elemfunc, elemwidth, elemcore, elemwraps, elemvar, elemdeck)
# ----------------------------------------
code_block = CodeBlock(seq=python_script) { seq[0]; seq[1]; seq[2]; seq[3]; seq[4]; seq[5]; seq[6]; seq[7]; }
returnListOrSingleValue = Python(IN[0]=elements_type, IN[1]=code_block.out0)  # IronPython2
# ---------- returnListOrSingleValue.python (4 lines) ----------
check = IN[0]
items = IN[1]
if isinstance(check, (list)): OUT = items
else: OUT = items[0]
# ----------------------------------------
layers = Output(returnListOrSingleValue)
returnListOrSingleValue_2 = Python(IN[0]=elements_type, IN[1]=code_block.out1)  # IronPython2; same code as returnListOrSingleValue
materials = Output(returnListOrSingleValue_2)
returnListOrSingleValue_3 = Python(IN[0]=elements_type, IN[1]=code_block.out2)  # IronPython2; same code as returnListOrSingleValue
functions = Output(returnListOrSingleValue_3)
returnListOrSingleValue_4 = Python(IN[0]=elements_type, IN[1]=code_block.out4)  # IronPython2; same code as returnListOrSingleValue
isCore = Output(returnListOrSingleValue_4)
returnListOrSingleValue_5 = Python(IN[0]=elements_type, IN[1]=code_block.out5)  # IronPython2; same code as returnListOrSingleValue
wraps = Output(returnListOrSingleValue_5)
returnListOrSingleValue_6 = Python(IN[0]=elements_type, IN[1]=code_block.out6)  # IronPython2; same code as returnListOrSingleValue
isVariable = Output(returnListOrSingleValue_6)
returnListOrSingleValue_7 = Python(IN[0]=elements_type, IN[1]=code_block.out7)  # IronPython2; same code as returnListOrSingleValue
isStructuralDeck = Output(returnListOrSingleValue_7)
code_block_2 = CodeBlock(widths=code_block.out3) { wdthMM=widths*304.8; }
widths = Output(code_block_2)
