# Dynamo custom node Elements_CopyToLevels.dyf "Elements.Copy To Levels" (Dynamo 2.17.1.4055)
# category: ACG Tools
# Copies elements to given levels.

elements = Input(elements: var[]..[])

# group: Control
list_create = List.Create(item0=elements)
code_block = CodeBlock(lst=list_create) { DSCore.List.Flatten(lst); }

# group: Process
code_block_2 = CodeBlock(x=code_block) { x[0]; }
level = Python(IN[0]=code_block_2)  # "Element.Level"; IronPython2
# ---------- level.python (39 lines) ----------
import clr
clr.AddReference('RevitAPI')
from Autodesk.Revit.DB import *

clr.AddReference("RevitNodes")
import Revit
clr.ImportExtensions(Revit.Elements)

def GetLevel(item):
	val = None
	if hasattr(item, "LevelId"): 
		val = item.Document.GetElement(item.LevelId)
		if val: return val
	if hasattr(item, "Level"):
		val = item.Level
		if val: return val
	if hasattr(item, "GenLevel"):
		val = item.GenLevel
		if val: return val
	if (item.GetType().ToString() in ("Autodesk.Revit.DB.Architecture.StairsRun", "Autodesk.Revit.DB.Architecture.StairsLanding")):
		item = item.GetStairs()
	if (item.GetType().ToString() == "Autodesk.Revit.DB.Architecture.Stairs"):
		try: return item.Document.GetElement(item.get_Parameter(BuiltInParameter.STAIRS_BASE_LEVEL_PARAM).AsElementId())
		except: pass
	if (item.GetType().ToString() == "Autodesk.Revit.DB.ExtrusionRoof"):
		try: return item.Document.GetElement(item.get_Parameter(BuiltInParameter.ROOF_CONSTRAINT_LEVEL_PARAM).AsElementId())
		except: pass
	if not val:
		try: return item.Document.GetElement(item.get_Parameter(BuiltInParameter.INSTANCE_REFERENCE_LEVEL_PARAM).AsElementId())
		except: 
			try: return item.Document.GetElement(item.get_Parameter(BuiltInParameter.INSTANCE_SCHEDULE_ONLY_LEVEL_PARAM).AsElementId())
			except: 
				try: return item.Document.GetElement(item.get_Parameter(BuiltInParameter.SCHEDULE_LEVEL_PARAM).AsElementId())
				except: return None

items = UnwrapElement(IN[0])

if isinstance(IN[0], list): OUT = [GetLevel(x) for x in items]
else: OUT = GetLevel(items)
# ----------------------------------------

# group: Level.Views
list_create_2 = List.Create(item0=level)
code_block_3 = CodeBlock(lst=list_create_2) { DSCore.List.Flatten(lst); }
python_script = Python(IN[0]=code_block_3)  # IronPython2
# ---------- python_script.python (22 lines) ----------
import clr
clr.AddReference('RevitAPI')
from Autodesk.Revit.DB import *

clr.AddReference("RevitNodes")
import Revit
clr.ImportExtensions(Revit.Elements)

levels = UnwrapElement(IN[0])

element_list = []

for lvl in levels:
    try:
        if lvl.Document.GetElement(lvl.FindAssociatedPlanViewId()) == None:
            element_list.append(None)
        else:
            element_list.append(lvl.Document.GetElement(lvl.FindAssociatedPlanViewId()))
    except:
        element_list.append(None)

OUT = element_list
# ----------------------------------------
returnListOrSinleValue = Python(IN[0]=level, IN[1]=python_script)  # IronPython2
# ---------- returnListOrSinleValue.python (4 lines) ----------
check = IN[0]
items = IN[1]
if isinstance(check, (list)): OUT = items
else: OUT = items[0]
# ----------------------------------------

levels = Input(levels: Revit.Elements.Level)

# group: Level.Views
list_create_3 = List.Create(item0=levels)
code_block_4 = CodeBlock(lst=list_create_3) { DSCore.List.Flatten(lst); }
python_script_2 = Python(IN[0]=code_block_4)  # IronPython2; same code as python_script
returnListOrSinleValue_2 = Python(IN[0]=level, IN[1]=python_script_2)  # IronPython2; same code as returnListOrSinleValue

copyToLevel = Python(IN[0]=code_block, IN[1]=returnListOrSinleValue, IN[2]=returnListOrSinleValue_2)  # "Element.CopyToLevel"; IronPython2
# ---------- copyToLevel.python (34 lines) ----------
import clr
from System.Collections.Generic import *
clr.AddReference('RevitAPI')
from Autodesk.Revit.DB import *
import Autodesk

clr.AddReference("RevitNodes")
import Revit
clr.ImportExtensions(Revit.Elements)

clr.AddReference("RevitServices")
import RevitServices
from RevitServices.Persistence import DocumentManager
from RevitServices.Transactions import TransactionManager

doc = DocumentManager.Instance.CurrentDBDocument
items = UnwrapElement(IN[0])
source_view = UnwrapElement(IN[1])
target_view = UnwrapElement(IN[2])

ids = []
for item in items:
    ids.append(item.Id)
item_list = List[ElementId](ids)

TransactionManager.Instance.EnsureInTransaction(doc)
new_items = ElementTransformUtils.CopyElements(source_view,item_list,target_view, None, None)
TransactionManager.Instance.TransactionTaskDone()

element_list = []
for item in new_items:
	element_list.append(doc.GetElement(item).ToDSType(False))

OUT = element_list
# ----------------------------------------
new_elements = Output(copyToLevel)
