# Dynamo custom node Excel_ClearContent.dyf "Excel.Clear Content" (Dynamo 2.17.1.4055)
# category: ACG Tools
# Deletes data from Excel cells and removes any formatting. Taken from BumbleBee and updated.

file_path = Input(file_path: string = null)  # The path to the Excel file as string
run_it = Input(run_it: bool = true)
sheet_name = Input(sheet_name: string = "Sheet1")  # The name of the spreadsheet
clear_content = Input(clear_content: bool = false)
clear_format = Input(clear_format: bool = false)
cell_range = Input(cell_range: string = null)  # Cell range to be cleared as A1:Z10
# note: From Bumblebee 2021.15.3
python_script = Python(IN[0]=file_path, IN[1]=run_it, IN[2]=sheet_name, IN[3]=clear_content, IN[4]=clear_format, IN[5]=cell_range)  # IronPython2
# ---------- python_script.python (130 lines) ----------
# Copyright(c) 2016, David Mans, Konrad Sobon
# @arch_laboratory, http://archi-lab.net, http://neoarchaic.net

import clr
import sys
import System
from System import Array
from System.Collections.Generic import *

clr.AddReferenceByName('Microsoft.Office.Interop.Excel, Version=11.0.0.0, Culture=neutral, PublicKeyToken=71e9bce111e9429c')
from Microsoft.Office.Interop import Excel
System.Threading.Thread.CurrentThread.CurrentCulture = System.Globalization.CultureInfo("en-US")
from System.Runtime.InteropServices import Marshal

pyt_path = r'C:\Program Files (x86)\IronPython 2.7\Lib'
sys.path.append(pyt_path)

assemblies = System.AppDomain.CurrentDomain.GetAssemblies()
path1 = [a.Location for a in assemblies if 'bumblebee,' in a.FullName][0]
path2 = System.IO.Path.GetDirectoryName(path1).rsplit('\\',1)[0]
bb_path = '%s\\extra\\' %path2
sys.path.append(bb_path)
import bumblebee as bb
import os

#The inputs to this node will be stored as a list in the IN variable.
dataEnteringNode = IN

filePath = IN[0]
runMe = IN[1]
sheetName = IN[2]
clearContent = IN[3]
clearFormat = IN[4]
cellRange = IN[5]

if filePath != None:
	if filePath.GetType() == System.IO.FileInfo:
		filePath = filePath.FullName

def SetUp(xlApp):
	# supress updates and warning pop ups
	xlApp.Visible = False
	xlApp.DisplayAlerts = False
	xlApp.ScreenUpdating = False
	return xlApp

def LiveStream():
	try:
		xlApp = Marshal.GetActiveObject("Excel.Application")
		xlApp.Visible = True
		xlApp.DisplayAlerts = False
		return xlApp
	except:
		return None

def ExitExcel(filePath, xlApp, wb, ws):
	# clean up before exiting excel, if any COM object remains
	# unreleased then excel crashes on open following time
	def CleanUp(_list):
		if isinstance(_list, list):
			for i in _list:
				Marshal.ReleaseComObject(i)
		else:
			Marshal.ReleaseComObject(_list)
		return None
	
	wb.SaveAs(unicode(filePath))
	xlApp.ActiveWorkbook.Close(False)
	xlApp.ScreenUpdating = True
	CleanUp([ws,wb,xlApp])
	return None

def ClearExcel(ws, cellRange, clearContents, clearFormats):
	# get origin and extent from range string
	# if no range supplied apply formatting to entire sheet
	if cellRange != None:
		origin = ws.Cells(bb.xlRange(cellRange)[1], bb.xlRange(cellRange)[0])
		extent = ws.Cells(bb.xlRange(cellRange)[3], bb.xlRange(cellRange)[2])
	else:
		origin = ws.Cells(ws.UsedRange.Row, ws.UsedRange.Column)
		extent = ws.Cells(ws.UsedRange.Rows(ws.UsedRange.Rows.Count).Row, ws.UsedRange.Columns(ws.UsedRange.Columns.Count).Column)
	if clearContents:
		ws.Range[origin, extent].ClearContents()
	if clearFormats:
		ws.Range[origin, extent].ClearFormats()
	return ws

if runMe:
	message = None
	try:
		errorReport = None
		message = "Success!"
		if filePath == None:
			# run excel in a live mode
			xlApp = LiveStream()
			wb = xlApp.ActiveWorkbook
			if sheetName == None:
				ws = xlApp.ActiveSheet
			else:
				ws = xlApp.Sheets(sheetName)
			ClearExcel(ws, cellRange, clearContent, clearFormat)
		else:
			try:
				xlApp = SetUp(Excel.ApplicationClass())
				if os.path.isfile(unicode(filePath)):
					xlApp.Workbooks.open(unicode(filePath))
					wb = xlApp.ActiveWorkbook
					ws = xlApp.Sheets(sheetName)
					ClearExcel(ws, cellRange, clearContent, clearFormat)
					#Marshal.ReleaseComObject(extent)
					#Marshal.ReleaseComObject(origin)
					ExitExcel(filePath, xlApp, wb, ws)
				else:
					message = "Specified file doesn't exists."
			except:
				xlApp.Quit()
				Marshal.ReleaseComObject(xlApp)
	except:
		# if error accurs anywhere in the process catch it
		import traceback
		errorReport = traceback.format_exc()
		pass
else:
	errorReport = None
	message = "Run Me is set to False. Please set \nto True if you wish to write data \nto Excel."

if errorReport == None:
	OUT = OUT = '\n'.join('{:^35}'.format(s) for s in message.split('\n'))
else:
	OUT = errorReport
# ----------------------------------------
OUT = Output(python_script)
