# Dynamo custom node File_Rename.dyf "File.Rename" (Dynamo 2.17.1.4055)
# category: ACG Tools
# Renames files by given directory, file extension, list of old file names and list of new file names

directory_path = Input(directory_path: string)
file_extension = Input(file_extension: string)
old_names = Input(old_names: string[]..[])
new_names = Input(new_names: string[]..[])
python_script = Python(IN[0]=directory_path, IN[1]=file_extension, IN[2]=old_names, IN[3]=new_names)  # IronPython2
# ---------- python_script.python (27 lines) ----------
import os


dir_path = IN[0]
ext = IN[1]
lst_old_names = IN[2]
lst_new_names = IN[3]

t = []

for old_name, new_name in zip(lst_old_names, lst_new_names):
    for file_name in os.listdir(dir_path):
        try:
            if (old_name + "." + ext) == file_name:

                old_path = dir_path +"\\"+ old_name +"."+ ext
                new_path = dir_path +"\\"+ new_name +"."+ ext
                t.append(new_path)
# Rename the file
                os.rename(old_path, new_path)
        except:
            continue




OUT = t
# ----------------------------------------
new_file_paths = Output(python_script)
