# Dynamo custom node Geometry_ExpandBoundingBox.dyf "Geometry.Expand Bounding Box" (Dynamo 2.17.1.4055)
# category: ACG Tools
# Expands element's bounding box. Taken from RIE

b_box = Input(b_box: var[]..[])
minPoint = BoundingBox.MinPoint(boundingBox=b_box)
maxPoint = BoundingBox.MaxPoint(boundingBox=b_box)
create = List.Create(item0=minPoint, item1=maxPoint)
transpose = List.Transpose(lists=create)
XAxis = Vector.XAxis()
reverse = Vector.Reverse(vector=XAxis)
YAxis = Vector.YAxis()
reverse_2 = Vector.Reverse(vector=YAxis)
ZAxis = Vector.ZAxis()
reverse_3 = Vector.Reverse(vector=ZAxis)
join = List.Join(list0=XAxis, list1=reverse, list2=YAxis, list3=reverse_2, list4=ZAxis, list5=reverse_3)
amount = Input(amount: int = 0)
byStartPointDirectionLength = Line.ByStartPointDirectionLength(startPoint=transpose@L2, direction=join, length=amount, lacing=CrossProduct)
flatten = List.Flatten()  # unwired: list
map = List.Map(list=byStartPointDirectionLength, f_x=flatten)
byGeometry = BoundingBox.ByGeometry(geom=map)
new_b_box = Output(byGeometry)
