# Dynamo custom node Geometry_FilterSurfaceByOrientation.dyf "Geometry.Filter Surfaces By Orientation" (Dynamo 2.17.1.4055)
# category: ACG Tools
# Takes surfaces and filters them by orientation - vertical, horizontal down or horizontal up. Taken from Clockwork for Dynamo 2.x

surfaces = Input(surfaces: Autodesk.DesignScript.Geometry.Surface[])
flatten = List.Flatten(list=surfaces)
code_block = CodeBlock { 0.5; }
normalAtParameter = Surface.NormalAtParameter(surface=flatten, u=code_block, v=code_block)
Z = Vector.Z(vector=normalAtParameter)

# group: Processing
formula = Formula("1.0e-9")

code_block_2 = CodeBlock(z=Z, almostzero=formula)
# ---------- code_block_2.designscript (2 lines) ----------
// Is vertical?
z >= (0 - almostzero) && z <= (0 + almostzero);
# ----------------------------------------
is_vertical = Output(code_block_2)
ZAxis = Vector.ZAxis()
isAlmostEqualTo = Vector.IsAlmostEqualTo(vector=normalAtParameter, otherVector=ZAxis)
is_horizontal_up = Output(isAlmostEqualTo)

# group: Processing
code_block_3 = CodeBlock { 0; -1; }
byCoordinates = Vector.ByCoordinates(x=code_block_3.out0, y=code_block_3.out0, z=code_block_3.out1)

isAlmostEqualTo_2 = Vector.IsAlmostEqualTo(vector=normalAtParameter, otherVector=byCoordinates)
is_horizontal_down = Output(isAlmostEqualTo_2)
filterByBoolMask = List.FilterByBoolMask(list=flatten, mask=code_block_2)
vertical = Output(filterByBoolMask.in)
filterByBoolMask_2 = List.FilterByBoolMask(list=flatten, mask=isAlmostEqualTo)
horizontal_up = Output(filterByBoolMask_2.in)
filterByBoolMask_3 = List.FilterByBoolMask(list=flatten, mask=isAlmostEqualTo_2)
horizontal_down = Output(filterByBoolMask_3.in)
