# Dynamo custom node Group_GetMembers.dyf "Groups.Get Members" (Dynamo 2.17.1.4055)
# category: ACG Tools
# Get all memeber elements of a group instance

groups = Input(groups: var[]..[])  # List of group instances to be processed
python_script = Python(IN[0]=groups)  # IronPython2
# ---------- python_script.python (25 lines) ----------
import clr
clr.AddReference('RevitAPI')
from Autodesk.Revit.DB import *

clr.AddReference("RevitNodes")
import Revit
clr.ImportExtensions(Revit.Elements)

input = IN[0]

if isinstance(input, list):
    groups = UnwrapElement(input)
else:
    groups = [UnwrapElement(input)]

element_list = []
for item in groups:
    try:
        member_list = list()
        for member in item.GetMemberIds():
            member_list.append(item.Document.GetElement(member))
        element_list.append(member_list)
    except:
        element_list.append(list())
OUT = element_list
# ----------------------------------------

# group: Processing
# note: ReturnListOrSingleValue
python_script_2 = Python(IN[0]=groups, IN[1]=python_script)  # IronPython2
# ---------- python_script_2.python (4 lines) ----------
check = IN[0]
items = IN[1]
if isinstance(check, (list)): OUT = items
else: OUT = items[0]
# ----------------------------------------

member_elements = Output(python_script_2)
