# Dynamo custom node QuickAudit_CADImportCheck.dyf "Quick Audit.CAD Imports Check" (Dynamo 2.12.1.8246)
# category: ACG Tools

python_script = Python()  # IronPython2
# ---------- python_script.python (24 lines) ----------
import clr
clr.AddReference("RevitAPI")
import Autodesk
from Autodesk.Revit.DB import *
# Import DocumentManager and TransactionManager
clr.AddReference("RevitServices")
import RevitServices
from RevitServices.Persistence import DocumentManager
# Import RevitAPI
clr.AddReference("RevitAPI")
import Autodesk
from Autodesk.Revit.DB import *

doc = DocumentManager.Instance.CurrentDBDocument

CADs = FilteredElementCollector(doc).OfClass(ImportInstance).ToElements()

imports = []

for c in CADs:
	if c.IsLinked == False:
		imports.append(c)
		
OUT = len(imports)
# ----------------------------------------
Result = Output(python_script)  # "*Result"
