# Dynamo custom node QuickAudit_DuplicateLevelsCheck.dyf "Quick Audit.Duplicate Levels Check" (Dynamo 2.17.1.4055)
# category: ACG Tools

code_block = CodeBlock { catL=Revit.Category.ByName("Levels"); allL=ElementQueries.OfCategory(catL); allL.Elevation; allL.Name; }
groupByKey = List.GroupByKey(list=code_block.out3, keys=code_block.out2)
count = List.Count(list=groupByKey.groups@L2)
code_block_2 = CodeBlock(count=count) { count>1; }
countTrue = List.CountTrue(list=code_block_2)
code_block_3 = CodeBlock { " & "; }
filterByBoolMask = List.FilterByBoolMask(list=groupByKey.groups, mask=code_block_2)
join = String.Join(separator=code_block_3, string0=filterByBoolMask.in@L2)

# group: Assing
Result = Output(countTrue)  # "*Result"
ListOfLevels = Output(join)  # "*ListOfLevels"
