# Dynamo custom node QuickAudit_FamilyNamingCheck.dyf "Quick Audit.Family Naming Check" (Dynamo 2.12.1.8246)
# category: ACG Tools

code_block = CodeBlock()
# ---------- code_block.designscript (32 lines) ----------
[
"Empty System Panel",
"System Panel",
"ACG_Section Tail Fitted",
"ACG_Head Callout",
"ACG_Section Head - GAD",
"ACG_Elevation - PRODUCTION",
"Elevation Mark Pointer_Circle-12mm",
"Leader Line",
"ACG_Head Level - Planning",
"ACG_Grid_Head",
"ACG_Section Head_WIP",
"UC-Universal Columns-Column",
"Columns_Rectangular",
"System Panel",
"UK_Circular Handrail",
"UK_Elipse Handrail",
"UK_Rectangular Handrail",
"V Corner Mullion",
"View Title",
"ACG_Section Tail Filled",
"Rectangular Mullion",
"Circular Mullion",
"L Corner Mullion",
"Trapezoid Corner Mullion",
"Quad Corner Mullion",
"Grid Head",
"Callout Head",
"Level Marker",
"Baluster Square",
"Enscape AssetDefinition - "
];
# ----------------------------------------
python_script = Python(IN[0]=code_block)  # IronPython2
# ---------- python_script.python (121 lines) ----------
# Load the Python Standard and DesignScript Libraries
import clr
import sys
sys.path.append('C:\Program Files (x86)\IronPython 2.7\Lib')
import System
from System import Array
from System.Collections.Generic import *
clr.AddReference('ProtoGeometry')
from Autodesk.DesignScript.Geometry import *
clr.AddReference("RevitNodes")
import Revit
clr.ImportExtensions(Revit.Elements)
clr.ImportExtensions(Revit.GeometryConversion)
clr.AddReference("RevitServices")
import RevitServices
from RevitServices.Persistence import DocumentManager 
from RevitServices.Transactions import TransactionManager 

clr.AddReference("RevitAPI")
clr.AddReference("RevitAPIUI")

import Autodesk 
from Autodesk.Revit.DB import *
from Autodesk.Revit.UI import *

doc = DocumentManager.Instance.CurrentDBDocument
uiapp = DocumentManager.Instance.CurrentUIApplication 
app = uiapp.Application 
uidoc = uiapp.ActiveUIDocument


defFams = IN[0]

all = []
allNames = []
filteredFamNames = []
filteredNames = []
withACG = []
withOutACG = []
compliant = []
nonCompliant = []
enscape = []

# collect all elements to be processed
famCol = FilteredElementCollector(doc).OfClass(Family).ToElements()
all.extend(famCol)
wallCol = FilteredElementCollector(doc).OfCategory(BuiltInCategory.OST_Walls).WhereElementIsElementType().ToElements()
all.extend(wallCol)
floorCol = FilteredElementCollector(doc).OfCategory(BuiltInCategory.OST_Floors).WhereElementIsElementType().ToElements()
all.extend(floorCol)
roofCol = FilteredElementCollector(doc).OfCategory(BuiltInCategory.OST_Roofs).WhereElementIsElementType().ToElements()
all.extend(roofCol)
ceilingCol = FilteredElementCollector(doc).OfCategory(BuiltInCategory.OST_Ceilings).WhereElementIsElementType().ToElements()
all.extend(ceilingCol)




# collect the names of all elements
for i in all:
	name = i.get_Parameter(BuiltInParameter.SYMBOL_NAME_PARAM).AsValueString()
	if name:
		allNames.append(name)
	else:
		name = i.Name
		allNames.append(name)
		
# filter out the default families		
for i in allNames:
	if not i in defFams:
		filteredNames.append(i)
		
# remove all .rvt
for i in filteredNames:
	if '.rvt' not in i:
		filteredFamNames.append(i)
		
# check if the name starts with "ACG"
for i in filteredFamNames:
	if i.startswith('ACG-'):
		withACG.append(i)
	else:
		withOutACG.append(i)
		
# check if the ACG families have valid code
for i in withACG:
	try:
		rest = i[8:]
		if rest.startswith('-'):
			compliant.append(i)
		else:
			nonCompliant.append(i)
	except:
		continue
		
# check if the non ACG families have valid codes
for i in withOutACG:
	try:
		if i[2] == '-' and i[7] == '-':
			compliant.append(i)
		elif i[3] == '-' and  i[8] == '-':
			compliant.append(i)		
		elif i[4] == '-' and  i[9] == '-':
			compliant.append(i)
		else:
			nonCompliant.append(i)
	except:
		continue
		
for i in filteredNames:
	if i.startswith('Enscape AssetDefinition'):
		compliant.append(i)
		nonCompliant.remove(i)



# calculate percentage
result = float(len(nonCompliant))/float(len(filteredNames))*100
result = round(result)

OUT = [compliant, nonCompliant, result]
# ----------------------------------------
code_block_2 = CodeBlock(x=python_script) { comp =x[0]; nonComp = x[1]; prcent = x[2]; }
Results_Naming = Output(code_block_2.prcent)  # "*Results Naming"
ListOf_Incompliant = Output(code_block_2.nonComp)  # "*ListOf Incompliant"
