# Dynamo custom node QuickAudit_GroupsCheck.dyf "Quick Audit.Groups Check" (Dynamo 2.17.1.4055)
# category: ACG Tools

# group: Process
python_script = Python()  # IronPython2
# ---------- python_script.python (81 lines) ----------
# Load the Python Standard and DesignScript Libraries
import clr
import sys
sys.path.append('C:\Program Files (x86)\IronPython 2.7\Lib')
import System
from System import Array
from System.Collections.Generic import *
clr.AddReference('ProtoGeometry')
from Autodesk.DesignScript.Geometry import *
clr.AddReference("RevitNodes")
import Revit
clr.ImportExtensions(Revit.Elements)
clr.ImportExtensions(Revit.GeometryConversion)
clr.AddReference("RevitServices")
import RevitServices
from RevitServices.Persistence import DocumentManager 
from RevitServices.Transactions import TransactionManager 

clr.AddReference("RevitAPI")
clr.AddReference("RevitAPIUI")

import Autodesk 
from Autodesk.Revit.DB import *
from Autodesk.Revit.UI import *

doc = DocumentManager.Instance.CurrentDBDocument
uiapp = DocumentManager.Instance.CurrentUIApplication 
app = uiapp.Application 
uidoc = uiapp.ActiveUIDocument


groupNames = []
withACG = []
withOutACG = []
compliant = []
nonCompliant = []

# collect all elements to be processed
groupTypes = FilteredElementCollector(doc).OfClass(GroupType)

# collect the names of all elements
for i in groupTypes:
	groupNames.append(i.LookupParameter('Type Name').AsString())
		
# check if the name starts with "ACG"
for i in groupNames:
	if i.startswith('ACG-'):
		withACG.append(i)
	else:
		withOutACG.append(i)
		
# check if the ACG families have valid code
for i in withACG:
	try:
		rest = i[8:]
		if rest.startswith('-'):
			compliant.append(i)
		else:
			nonCompliant.append(i)
	except:
		continue
		
# check if the non ACG families have valid codes
for i in withOutACG:
	try:
		if i[2] == '-' and i[7] == '-':
			compliant.append(i)
		elif i[3] == '-' and  i[8] == '-':
			compliant.append(i)		
		elif i[4] == '-' and  i[9] == '-':
			compliant.append(i)
		else:
			nonCompliant.append(i)
	except:
		continue

# calculate percentage
result = float(len(nonCompliant))/float(len(groupNames))*100
result = round(result)

OUT = [compliant, nonCompliant, result]
# ----------------------------------------
# note: check naming
code_block = CodeBlock(x=python_script) { x[2]; x[1]; }
Results_Naming = Output(code_block.out0)  # "*Results Naming"
List_Naming = Output(code_block.out1)  # "*List_Naming"

# group: Process
code_block_2 = CodeBlock { true; }
groups_audit = Python(IN[0]=code_block_2)  # IronPython2
# ---------- groups_audit.python (107 lines) ----------
import clr
clr.AddReference('RevitAPI')
import Autodesk
from Autodesk.Revit.DB import *

clr.AddReference("RevitNodes")
import Revit
clr.ImportExtensions(Revit.Elements)

clr.AddReference("RevitServices")
import RevitServices
from RevitServices.Persistence import DocumentManager
from RevitServices.Transactions import TransactionManager

from operator import itemgetter

doc = DocumentManager.Instance.CurrentDBDocument

groupTypes = FilteredElementCollector(doc).OfClass(GroupType)

output = []
out = []
groupNames = []
groupInstances = []
groupFamily = []
unconHeight = []
groupNested = [] 
nestedNames = []
nestedGroups = []
restoreExcluded = []
elements = []
output = []

if IN[0]:
	TransactionManager.Instance.EnsureInTransaction(doc)
	
	for groupType in groupTypes:
		
		groupNames.append(groupType.LookupParameter("Type Name").AsString())
		groupInstances.append(groupType.Groups.Size)
		groupFamily.append(groupType.FamilyName.ToString())
		if groupType.Groups.Size>0:
			groupSet = groupType.Groups.ForwardIterator()
			numOfMem = 0
			excluded = "False"
			uncon = "False"
			nested = "False"
			while groupSet.MoveNext():
				names = []
				membersIds = groupSet.Current.GetMemberIds()
				for id in membersIds:
					item = doc.GetElement(id)
					if item.Category != None:
						if item.Category.Name == "Walls":
							try:
								if item.LookupParameter("Top Constraint").AsString() == "Unconnected":
									uncon = "True"
							except:
								pass
					
						if item.Category.Name == "Model Groups" or item.Category.Name == "Detail Groups":
							nested = "True"
							names.append(item.Name)
				
				if numOfMem == 0:
					numOfMem = len(membersIds)
				elif numOfMem < len(membersIds):
					numOfMem = len(membersIds)
					excluded = "True"
				elif numOfMem > len(membersIds):
					excluded = "True"
			restoreExcluded.append(excluded)
			unconHeight.append(uncon)
			groupNested.append(nested)
			nestedNames.append(names)
		else:
			restoreExcluded.append("No instances in project")
			
			
		
	output.append(groupNames)
	output.append(groupFamily)
	output.append(groupInstances)
	output.append(restoreExcluded)
	output.append(unconHeight)
	output.append(groupNested)
	
	
	output = map(list, zip(*output))
	for i in xrange(len(output)):
		temp = output[i]
		for item in nestedNames[i]:
			if item != None:
				temp.append(item)
		out.append(temp)
		
	
	out = sorted(out, key=itemgetter(0))	
	header = ["Group name", "Type of group", "Number of instances", "Restore excluded", "Unconnected height", "Groups nested", "Nested groups names"]
	out.insert(0,header)
	OUT = out

	#OUT = nestedNames
	TransactionManager.Instance.TransactionTaskDone()
else: 
	OUT = "Set RunIt to true"
	
# ----------------------------------------
transpose = List.Transpose(lists=groups_audit)
code_block_3 = CodeBlock(x=transpose) { x[5]; }
restOfItems = List.RestOfItems(list=code_block_3)
code_block_4 = CodeBlock(v=restOfItems) { v == "True"; }
countTrue = List.CountTrue(list=code_block_4)
count = List.Count(list=restOfItems)

# group: Assing
code_block_5 = CodeBlock(nonCompliant=countTrue, all=count) { DSCore.Math.Round(nonCompliant / all *100); }
Results_Nesting = Output(code_block_5)  # "*Results Nesting"
