# Dynamo custom node QuickAudit_RedundantAreaCheck.dyf "Quick Audit.Redundant Area Check" (Dynamo 2.12.1.8246)
# category: ACG Tools

python_script = Python()  # IronPython2
# ---------- python_script.python (20 lines) ----------
#Copyright (c) mostafa el ayoubi
#Node-mode 2016 elayoub.mostafa@gmail.com
import datetime
import os
import clr
clr.AddReference('RevitAPI')
from Autodesk.Revit.DB import*
clr.AddReference('RevitServices')
from RevitServices.Persistence import DocumentManager

doc = DocumentManager.Instance.CurrentDBDocument
path = doc.PathName
docname = path.encode('string-escape')


areas = FilteredElementCollector(doc)\
.OfCategory(BuiltInCategory.OST_Areas)\
.ToElements()

OUT = sum(1 for area in areas if not area.Area > 0)
# ----------------------------------------
Result = Output(python_script)  # "*Result"
