# Dynamo custom node QuickAudit_SheetNamingCheck.dyf "Quick Audit.Sheets Naming Check" (Dynamo 2.12.1.8246)
# category: ACG Tools

# group: Input
code_block = CodeBlock { ["AA","BB","CC","DD","ZZ","XX","90","92","93","55","95"]; }
code_block_2 = CodeBlock { ["00","01","02","03","04","05","06","07","08","09","10","11","12","13","14","15","16","17","18","19","20","21","22","23","24","25","26","27","28","29","30","GF","XX","ZZ","B1","B2","B3","B4","B5","B6","B7","B8","B9","M1","M2","M3","M4","M5","M6","M7","M8","M9","RF","UG","LG"]; }
code_block_3 = CodeBlock { ["D","G","I","L","M","T","V","DR","M2","MR","VS","BQ","CA","CO","CP","DB","FN","HS","IE","MI","MS","PP","PR","RD","RI","RP","SA","SH","SN","SP","SU","SK"]; }

NumberLength = Input(NumberLength: var[]..[])

# group: Visualisation
code_block_4 = CodeBlock(volume=code_block, level=code_block_2, type=code_block_3) { volume; level; type; }
python_script = Python(IN[0]=code_block_4.volume, IN[1]=code_block_4.level, IN[2]=code_block_4.type, IN[3]=NumberLength)  # IronPython2
# ---------- python_script.python (113 lines) ----------
# Load the Python Standard and DesignScript Libraries
import clr
import sys
sys.path.append('C:\Program Files (x86)\IronPython 2.7\Lib')
import System
from System import Array
from System.Collections.Generic import *
clr.AddReference('ProtoGeometry')
from Autodesk.DesignScript.Geometry import *
clr.AddReference("RevitNodes")
import Revit
clr.ImportExtensions(Revit.Elements)
clr.ImportExtensions(Revit.GeometryConversion)
clr.AddReference("RevitServices")
import RevitServices
from RevitServices.Persistence import DocumentManager 
from RevitServices.Transactions import TransactionManager 

clr.AddReference("RevitAPI")
clr.AddReference("RevitAPIUI")

import Autodesk 
from Autodesk.Revit.DB import *
from Autodesk.Revit.UI import *

doc = DocumentManager.Instance.CurrentDBDocument
uiapp = DocumentManager.Instance.CurrentUIApplication 
app = uiapp.Application 
uidoc = uiapp.ActiveUIDocument


vVol = IN[0]
vLvl = IN[1]
vType = IN[2]
numbLen = IN[3]

temp1 = []
nonCompliant = []
validSheets = []
prodSheets = []
sheetLen = []

# collect all elements to be processed
sheetCol = FilteredElementCollector(doc).OfCategory(BuiltInCategory.OST_Sheets).WhereElementIsNotElementType().ToElements()
for s in sheetCol:
	if not s.IsPlaceholder:
		validSheets.append(s)

# filter out the template sheets
templateNames = ['TEMPLATE', 'ACG']
temp = validSheets
validSheets = []
for s in temp:
	name = s.get_Parameter(BuiltInParameter.SHEET_NAME).AsValueString()
	if name not in templateNames:
		if s.LookupParameter('Sheet Phase').HasValue == True:
			validSheets.append(s)
		
for s in validSheets:
	if 'PRODUCTION' in s.LookupParameter('Sheet Phase').AsString():
		prodSheets.append(s)


	


# 
def getParameterValue(sheets, paramName, values):
	fail = []
	if isinstance(values, list):
		for s in sheets:
			v = s.LookupParameter(paramName).AsString()
			if v not in values:
				fail.append(s)
	else:
		for s in sheets:	
			v = s.LookupParameter(paramName).AsString()
			if v != values:
				fail.append(s)
	return fail

if len(prodSheets) == 0:
	OUT = [0, ["No PRODUCTION sheets in the model."]]
	
else:

	# failVol = getParameterValue(toProcess, 'ACG_Volume', vVol)
	# nonCompliant += failVol
	failLvl = getParameterValue(prodSheets, 'ACG_Level', vLvl)
	nonCompliant += failLvl
	failType = getParameterValue(prodSheets, 'ACG_Type', vType)
	nonCompliant += failType

	# check if the sheet numbers are valid
	failNumb = []
	for s in prodSheets:	
	 	numb = s.get_Parameter(BuiltInParameter.SHEET_NUMBER).AsValueString()
	 	if not numb.isnumeric() or len(numb) != numbLen:
	 		failNumb.append(s)

	nonCompliant += failNumb

	# make the nonCompliant list uniquw
	temp = nonCompliant
	nonCompliant = []
	for s in temp:
		numb= s.get_Parameter(BuiltInParameter.SHEET_NUMBER).AsValueString()
		if numb not in nonCompliant:
			nonCompliant.append(numb)
	
	result = round(len(nonCompliant)/float(len(prodSheets))*100)

	OUT = [result, nonCompliant]
# ----------------------------------------
code_block_5 = CodeBlock(x=python_script) { result=x[0]; listSheets=x[1]; }

Results = Output(code_block_5.result)  # "*Results"
Incompliant_sheets = Output(code_block_5.listSheets)  # "*Incompliant sheets"
