# Dynamo custom node QuickAudit_ViewNamingCheck.dyf "Quick Audit.View Naming Check" (Dynamo 2.17.1.4055)
# category: ACG Tools
# Check if views placed on "DR" sheets are named correctly
# packages: Orchid 260.1.0.7729, LunchBox for Dynamo 2016.11.11

# group: Filtering
code_block = CodeBlock { "Views"; }
byName = Category.ByName(name=code_block)
all_elements_of_category = ElementsOfCategory(Category=byName)
removeNulls = Lists.Manage.RemoveNulls(Data=all_elements_of_category)
code_block_2 = CodeBlock { "Sheet Number"; "Sheet Number : "; ""; }
# note: Collect views and get their sheets (incl views not on sheets)
parameterByName = Parameter.ParameterByName(element=removeNulls.Cleaned, name=code_block_2.out0)
string_from_object = FromObject(obj=parameterByName)
replace = String.Replace(string=string_from_object, searchFor=code_block_2.out1, replaceWith=code_block_2.out2)

# group: Control
code_block_3 = CodeBlock()
# ---------- code_block_3.designscript (9 lines) ----------
catSheets=Revit.Elements.Category.ByName("Sheets");
ElementQueries.OfCategory(catSheets);

"Sheet Number";

"Sheet Phase";


"Project Information";
# ----------------------------------------
getParameterValueByName = Element.GetParameterValueByName(element=code_block_3.out1, parameterName=code_block_3.out3)
getParameterValueByName_2 = Element.GetParameterValueByName(element=code_block_3.out1, parameterName=code_block_3.out3)
code_block_4 = CodeBlock(lst1=getParameterValueByName, lst2=getParameterValueByName_2) { lst1=="PRODUCTION"; lst2=="WIP"; }
filterByBoolMask = List.FilterByBoolMask(list=code_block_3.out1, mask=code_block_4.out0)
filterByBoolMask_2 = List.FilterByBoolMask(list=code_block_3.out1, mask=code_block_4.out1)
list_create = List.Create(item0=filterByBoolMask.in, item1=filterByBoolMask_2.in)
code_block_5 = CodeBlock(lst=list_create) { DSCore.List.Flatten(lst); }

# group: Filtering
code_block_6 = CodeBlock { "ACG_Type"; }
getParameterValueByName_3 = Element.GetParameterValueByName(element=code_block_5, parameterName=code_block_6)
# note: Collect "DR" sheets
code_block_7 = CodeBlock(sheetType=getParameterValueByName_3) { sheetType=="DR"; }
filterByBoolMask_3 = List.FilterByBoolMask(list=code_block_5, mask=code_block_7)
code_block_8 = CodeBlock { "Sheet Number"; }
getParameterValueByName_4 = Element.GetParameterValueByName(element=filterByBoolMask_3.in, parameterName=code_block_8)

# group: Filtering
# note: Filter only views placed on "DR" sheets
eq = replace == getParameterValueByName_4  # lacing=CrossProduct
anyTrue = Orchid.Common.List.AnyTrue(list=eq)
filterByBoolMask_4 = List.FilterByBoolMask(list=removeNulls.Cleaned, mask=anyTrue)

# group: Processing
# note: Get the name of the view
name = Element.Name(element=filterByBoolMask_4.in)
code_block_9 = CodeBlock { "Sheet Number"; }
# note: Get the sheet of that view
getParameterValueByName_5 = Element.GetParameterValueByName(element=filterByBoolMask_4.in, parameterName=code_block_9)

# group: Processing
# note: Check the sheet code
startsWith = String.StartsWith(string=name@L1, searchFor=getParameterValueByName_5@L1)
filterByBoolMask_5 = List.FilterByBoolMask(list=filterByBoolMask_4.in, mask=startsWith)

# group: Processing
code_block_10 = CodeBlock { 0; 4; "-"; }
remove = String.Remove(string=name, startIndex=code_block_10.out0, count=code_block_10.out1)
# note: Check if the fifth symbol is "-"
startsWith_2 = String.StartsWith(string=remove, searchFor=code_block_10.out2)
filterByBoolMask_6 = List.FilterByBoolMask(list=filterByBoolMask_4.in, mask=startsWith_2)

# group: Processing
code_block_11 = CodeBlock { 0; 7; "-"; }
remove_2 = String.Remove(string=name, startIndex=code_block_11.out0, count=code_block_11.out1)
# note: Check if the fifth symbol is "-"
startsWith_3 = String.StartsWith(string=remove_2, searchFor=code_block_11.out2)
filterByBoolMask_7 = List.FilterByBoolMask(list=filterByBoolMask_4.in, mask=startsWith_3)

# group: Output
list_create_2 = List.Create(item0=filterByBoolMask_5.out, item1=filterByBoolMask_6.out, item2=filterByBoolMask_7.out)
code_block_12 = CodeBlock(lst=list_create_2, viewsOnSheets=filterByBoolMask_4.in)
# ---------- code_block_12.designscript (12 lines) ----------
allFailing=DSCore.List.Flatten(lst);
uniques=DSCore.List.UniqueItems(allFailing);
numNonComp=DSCore.List.Count(uniques);

numTotal=DSCore.List.Count(viewsOnSheets);


percent=numNonComp/numTotal*100;
percent==0;
DSCore.Math.Round(percent);

".";
# ----------------------------------------
string_from_object_2 = FromObject(obj=code_block_12.out6)
split = String.Split(string=string_from_object_2, separator0=code_block_12.out7)
code_block_13 = CodeBlock(result=split) { result[0]; }

Result = Output(code_block_13)  # "*Result"
ListOfViews = Output(code_block_12.uniques)  # "*ListOfViews"
