# Dynamo custom node QuickAudit_ViewsOnSheetsNamingCheck.dyf "Quick Audit.Views On Sheets Naming Check" (Dynamo 2.17.1.4055)
# category: ACG Tools
# Check views placed on PRODUCTION sheets. Only Plans, Elevations and Sections

# group: Output
code_block = CodeBlock()  # unwired: lst, viewsOnSheets
# ---------- code_block.designscript (12 lines) ----------
allFailing=DSCore.List.Flatten(lst);
uniques=DSCore.List.UniqueItems(allFailing);
numNonComp=DSCore.List.Count(uniques);

numTotal=DSCore.List.Count(viewsOnSheets);


percent=numNonComp/numTotal*100;
percent==0;
DSCore.Math.Round(percent);

".";
# ----------------------------------------
string_from_object = FromObject(object=code_block.out6)
split = String.Split(string=string_from_object, separator0=code_block.out7)
code_block_2 = CodeBlock(percent=split)
# ---------- code_block_2.designscript (4 lines) ----------
"Excellent! All views placed on sheets are named in compliance with ACG's protocols.";

percent[0]+
"% of all views placed on sheets are not named in compliance with ACG's protocols. Please review and rename.";
# ----------------------------------------
code_block_3 = CodeBlock(x=code_block.out5, a=code_block_2.out0, b=code_block_2.out1) { x?a:b; }

# group: Input - get PRODUCTION sheets
python_script = Python()  # IronPython2; unwired: IN[0]
# ---------- python_script.python (37 lines) ----------
import clr
import sys
sys.path.append('C:\Program Files (x86)\IronPython 2.7\Lib')
import System
from System import Array
from System.Collections.Generic import *
clr.AddReference('ProtoGeometry')
from Autodesk.DesignScript.Geometry import *
clr.AddReference("RevitNodes")
import Revit
clr.ImportExtensions(Revit.Elements)
clr.ImportExtensions(Revit.GeometryConversion)
clr.AddReference("RevitServices")
import RevitServices
from RevitServices.Persistence import DocumentManager 
from RevitServices.Transactions import TransactionManager 

clr.AddReference("RevitAPI")
clr.AddReference("RevitAPIUI")

import Autodesk 
from Autodesk.Revit.DB import *
from Autodesk.Revit.UI import *

doc = DocumentManager.Instance.CurrentDBDocument
uiapp = DocumentManager.Instance.CurrentUIApplication 
app = uiapp.Application 
uidoc = uiapp.ActiveUIDocument

#######OK NOW YOU CAN CODE########

sheets = FilteredElementCollector(doc)\
.OfCategory(BuiltInCategory.OST_Sheets)\
.WhereElementIsNotElementType().ToElements()

OUT = [s for s in sheets
if "PROD" in s.LookupParameter("Sheet Phase").AsString()]
# ----------------------------------------

# group: Process
code_block_4 = CodeBlock(lst=python_script) { sheet_lst = Sheets.Viewports(lst); }
view = Viewport.View(viewport=code_block_4)
flatten = List.Flatten(list=view)
code_block_5 = CodeBlock()
# ---------- code_block_5.designscript (7 lines) ----------
[
"FloorPlan",
"Elevation",
"Section",
"CeilingPlan",
"AreaPlan"
];
# ----------------------------------------

# group: Process - check in the view type is in the list
python_script_2 = Python(IN[0]=flatten, IN[1]=code_block_5)  # IronPython2
# ---------- python_script_2.python (41 lines) ----------
import clr
import sys
sys.path.append('C:\Program Files (x86)\IronPython 2.7\Lib')
import System
from System import Array
from System.Collections.Generic import *
clr.AddReference('ProtoGeometry')
from Autodesk.DesignScript.Geometry import *
clr.AddReference("RevitNodes")
import Revit
clr.ImportExtensions(Revit.Elements)
clr.ImportExtensions(Revit.GeometryConversion)
clr.AddReference("RevitServices")
import RevitServices
from RevitServices.Persistence import DocumentManager 
from RevitServices.Transactions import TransactionManager 

clr.AddReference("RevitAPI")
clr.AddReference("RevitAPIUI")

import Autodesk 
from Autodesk.Revit.DB import *
from Autodesk.Revit.UI import *

doc = DocumentManager.Instance.CurrentDBDocument
uiapp = DocumentManager.Instance.CurrentUIApplication 
app = uiapp.Application 
uidoc = uiapp.ActiveUIDocument

#######OK NOW YOU CAN CODE########

input = IN[0]
lst = IN[1]

if isinstance(input, list):
    views = UnwrapElement(input)
else:
    views = UnwrapElement([input])

OUT = [v for v in views
if str(v.ViewType) in lst]
# ----------------------------------------

code_block_6 = CodeBlock { "Sheet Number"; }
getParameterValueByName = Element.GetParameterValueByName(element=python_script_2, parameterName=code_block_6)

# group: Processing
name = Element.Name(element=python_script_2)
code_block_7 = CodeBlock(sheetNumber=getParameterValueByName) { sheetNumber+"-"; }
startsWith = String.StartsWith(string=name, searchFor=code_block_7)
filterByBoolMask = List.FilterByBoolMask(list=python_script_2, mask=startsWith)
code_block_8 = CodeBlock(nonCompliant=filterByBoolMask.out) { nonCompliant.Name; }
code_block_9 = CodeBlock(lst=code_block_8, viewsOnSheets=python_script_2)
# ---------- code_block_9.designscript (6 lines) ----------
allFailing=DSCore.List.Flatten(lst);
uniques=DSCore.List.UniqueItems(allFailing);
numNonComp=DSCore.List.Count(uniques);
numTotal=DSCore.List.Count(viewsOnSheets);
percent=numNonComp/numTotal*100;
DSCore.Math.Round(percent);
# ----------------------------------------

# group: Control
isEmpty = List.IsEmpty(list=python_script)
# note: report "0" if there are not PRODUCTION sheets
code_block_10 = CodeBlock(empt=isEmpty, b=code_block_9.out5) { empt==true?0:b; }

# group: Visualisation
Result = Output(code_block_10)  # "_Result"
ListOfViews = Output(code_block_8)  # "_ListOfViews"
