# Dynamo custom node Views_ByGeometry.dyf "Views.By Geometry" (Dynamo 2.17.1.4055)
# category: ACG Tools
# Modified from Create Element View in the BIM4Struc package

# group: Input
cs_point = Input(cs_point: var[]..[])  # Indicate the section center point This point should lie within the solid geometry of the selected element
x_vector = Input(x_vector: var[]..[])  # This vector defines the length direction of the section view
y_vector = Input(y_vector: var[]..[])  # This vector defines the width direction of the section view
geometry = Input(geometry: var[]..[])  # Select the Revit elements
crop_region_offset = Input(crop_region_offset: double)  # Distance between object countours and section crop region
view_depth = Input(view_depth: double)  # Defines the depth of the section view
view_name = Input(view_name: string[])  # The name of the section view

# group: ELEMENT GEOMETRY SIMPLIFICATION
type = Object.Type(object=geometry)
code_block = CodeBlock { "Autodesk.DesignScript.Geometry.Solid"; }
# note: Filter solids from the element.geometry output
eq = type == code_block
filterByBoolMask = List.FilterByBoolMask(list=geometry, mask=eq)
byGeometry = BoundingBox.ByGeometry(geom=filterByBoolMask.in, lacing=Longest)
# note: Union solids in case the object consists of multiple, and get the bounding box of it, to create rectangular boundaries representing the view planes.
toCuboid = BoundingBox.ToCuboid(boundingBox=byGeometry)

# group: APPLY CS AND WORKPLANE
# note: Defines the coordinate system for the direction of the section view.
# This is taken in the centroid of the solid geometry to be able to define negative and positive values for the min/max point
# Top view:
# X=length axis element
# Y=normal at length axis
# Front view:
# X=length axis element
# Y=Global Z axis
# Cross section view:
# X=normal axis element
# Y=Global Z axis
byOriginVectors = CoordinateSystem.ByOriginVectors(origin=cs_point, xAxis=x_vector, yAxis=y_vector, lacing=Longest)
centroid = Solid.Centroid(solid=filterByBoolMask.in)
# note: Generate a plane at the solid center which is orientated to the view cs. This plane is used to detect the boundaries of the section view.
byOriginXAxisYAxis = Plane.ByOriginXAxisYAxis(origin=centroid, xAxis=x_vector, yAxis=y_vector, lacing=Longest)

# group: DETECT SECTION BOUNDARY CURVES AND WORKPOINTS
intersect = Geometry.Intersect(geometry=toCuboid, other=byOriginXAxisYAxis, lacing=Longest)
flatten = List.Flatten(list=intersect)
# note: Detect the perimeter curves of the cutting surface at the solid centroid
perimeterCurves = Surface.PerimeterCurves(surface=flatten)
byJoinedCurves = PolyCurve.ByJoinedCurves(curves=perimeterCurves)
code_block_2 = CodeBlock(x=crop_region_offset) { [x,-x]; }
# note: Apply the offset on the cutting surface perimeter curves.
offsetMany = PolyCurve.OffsetMany(polyCurve=byJoinedCurves, signedDistance=code_block_2)  # unwired: extendCircular
# note: If the offset value exceeds the half-width of the surface, then it generates a "null" value for the generated polycurve.
# This might return an error in the Curve.Offset node. To filter out the "null" values, the List.FilterByBoolMask is used.
isNull = Object.IsNull(object=offsetMany)
filterByBoolMask_2 = List.FilterByBoolMask(list=offsetMany, mask=isNull)
length = Curve.Length()  # unwired: curve
maximumItemByKey = List.MaximumItemByKey(list=filterByBoolMask_2.out@L2, keyFunction=length)
# note: Get the external polycurve of the offsetted polycurves.
explode = Geometry.Explode(geometry=maximumItemByKey)
# note: Get the single curves and their starting point to define the min and max boundary values
startPoint = Curve.StartPoint(curve=explode)

# group: TRANSLATE TO WCS FOR minPoint / maxPoint Calc
identity = CoordinateSystem.Identity()
transform = Geometry.Transform(contextCoordinateSystem=identity)  # unwired: geometry, fromCoordinateSystem
# note: As Point.X and Point.Y only work according to global WCS, the curves are transformed from the solid.centroid to the WCS in order to define the MinPoint and MaxPoint of the cut surface (offset values already included)
combine = List.Combine(combineFunction=transform, list0=startPoint, list1=byOriginVectors)
X = Point.X(point=combine)
minimumItem = List.MinimumItem(list=X)
Y = Point.Y(point=combine)
minimumItem_2 = List.MinimumItem(list=Y)
maximumItem = List.MaximumItem(list=X)
maximumItem_2 = List.MaximumItem(list=Y)

# group: CREATE SECTION VIEW ACCORDING BOUNDING BOX
code_block_3 = CodeBlock(CropRegionOffset=crop_region_offset, ViewDepth=view_depth)
# ---------- code_block_3.designscript (7 lines) ----------
//Z value calculation
//in accordance with the
//Centroid point
//Startingpoint of sectionview
-CropRegionOffset;
//Relative depth of sectionview
ViewDepth-CropRegionOffset;
# ----------------------------------------
byCoordinates = Point.ByCoordinates(x=minimumItem, y=minimumItem_2, z=code_block_3.out0)
# note: The section view is created according the CS, defined by the centroid and the given section view direction.
# The minPoint / maxPoint is defined by the local oriented bounding box + offset of the element.
byCoordinates_2 = Point.ByCoordinates(x=maximumItem, y=maximumItem_2, z=code_block_3.out1)
byCoordinateSystemMinPointMaxPoint = SectionView.ByCoordinateSystemMinPointMaxPoint(cs=byOriginVectors, minPoint=byCoordinates, maxPoint=byCoordinates_2)
code_block_4 = CodeBlock { "View Name"; }
setParameterByName = Element.SetParameterByName(element=byCoordinateSystemMinPointMaxPoint, parameterName=code_block_4, value=view_name)

section_view = Output(setParameterByName)

# group: Input
code_block_5 = CodeBlock()  # unwired: Xvector
# ---------- code_block_5.designscript (2 lines) ----------
/*This vector defines the length direction of the section view*/
Xvector: var[]..[];
# ----------------------------------------
code_block_6 = CodeBlock()  # unwired: Yvector
# ---------- code_block_6.designscript (2 lines) ----------
/*This vector defines the width direction of the section view*/
Yvector: var[]..[];
# ----------------------------------------
code_block_7 = CodeBlock()  # unwired: CropRegionOffset
# ---------- code_block_7.designscript (2 lines) ----------
/*Distance between object countours and section crop region*/
CropRegionOffset: double;
# ----------------------------------------
code_block_8 = CodeBlock()  # unwired: ViewDepth
# ---------- code_block_8.designscript (2 lines) ----------
/*Defines the depth of the section view*/
ViewDepth: double;
# ----------------------------------------
code_block_9 = CodeBlock()  # unwired: CSPoint
# ---------- code_block_9.designscript (4 lines) ----------
/*Indicate the section center point
This point should lie within the solid geometry
of the selected element*/
_CSPoint: var[]..[];
# ----------------------------------------
code_block_10 = CodeBlock()  # unwired: Viewname
# ---------- code_block_10.designscript (2 lines) ----------
/*The name of the section view*/
_Viewname: string[];
# ----------------------------------------
code_block_11 = CodeBlock()  # unwired: Geometry
# ---------- code_block_11.designscript (2 lines) ----------
/*Select the Revit elements*/
_Geometry: var[]..[];
# ----------------------------------------
