# Dynamo custom node Views_ViewType.dyf "Views.Get Type" (Dynamo 2.17.1.4055)
# category: ACG Tools
# Gets the type of a given view

views = Input(views: var[]..[])  # List of views to be processed
python_script = Python(IN[0]=views)  # IronPython2
# ---------- python_script.python (19 lines) ----------
import clr
clr.AddReference('ProtoGeometry')
from Autodesk.DesignScript.Geometry import *

clr.AddReference('RevitAPI')
from Autodesk.Revit.DB import *

def tolist(obj):
	if isinstance(obj, list):
		return UnwrapElement(obj)
	else:
		return [UnwrapElement(obj)]
		
views = tolist(IN[0])

OUT = []

for view in views:
	OUT.append(view.ViewType)
# ----------------------------------------
view_types = Output(python_script)
