# Dynamo custom node Data_GetGraphPath.dyf "Data.Get Graph Path" (Dynamo 2.12.1.8246)
# category: ACG Tools
# Gets the parh of the active Dynamo graph

python_script = Python()  # IronPython2
# ---------- python_script.python (13 lines) ----------
import clr
clr.AddReference('DynamoRevitDS')
import Dynamo 

dynamoRevit = Dynamo.Applications.DynamoRevit()
currentWorkspace = dynamoRevit.RevitDynamoModel.CurrentWorkspace

path = currentWorkspace.FileName

fullFileName = path.Split("\\")[-1] # with extension
fileName = fullFileName.Replace(".dyn","")

OUT = path, fullFileName, fileName
# ----------------------------------------
code_block = CodeBlock(x=python_script) { x[0]; x[1]; x[2]; }
file_path = Output(code_block.out0)  # Full path of the file
full_file_name = Output(code_block.out1)  # File name with extension
file_name = Output(code_block.out2)  # File name without extension
