# Dynamo custom node Data_ScriptUseLog.dyf "Data.Script Use Log" (Dynamo 2.12.1.8246)
# category: ACG Tools
# Adds an entry to TXT document every time a script is run.

graph_name = Input(graph_name: var[]..[])  # Graph name
graph_path = Input(graph_path: var[]..[])  # Graph path
code_block = CodeBlock { 4; }
fileGetParentDirectory = Custom[FileGetParentDirectory](path=graph_path, index_up=code_block)
python_script = Python(IN[0]=graph_name, IN[1]=fileGetParentDirectory)  # IronPython2
# ---------- python_script.python (52 lines) ----------
import clr
clr.AddReference("RevitServices")
import RevitServices
from RevitServices.Persistence import DocumentManager
from RevitServices.Transactions import TransactionManager
clr.AddReference("RevitAPI")
import Autodesk
from Autodesk.Revit.DB import *
import System
import sys
sys.path.append(r"C:\Program Files (x86)\IronPython 2.7\Lib")
import os
import shutil
from datetime import datetime
from System import Environment


app = DocumentManager.Instance.CurrentUIApplication.Application
doc = DocumentManager.Instance.CurrentDBDocument

graphName = 		IN[0]
dynamoFolderPath = 	IN[1]

user = app.Username

# get the project number
pi = FilteredElementCollector(doc)\
.OfCategory(BuiltInCategory.OST_ProjectInformation)\
.FirstElement()

prjNumb = pi.LookupParameter('Project Number').AsString()
# get day
day = str(datetime.now().strftime('%d.%m.%y'))
# get hour
hour = str(datetime.now().strftime('%H:%M'))

# ASSEMBLE THE DATA
rawData = [graphName, user, prjNumb, day, hour]
data = ','.join(rawData) + '\n'

# get the name of the TXT file
fileDate = str(datetime.now().strftime('%y%m'))
fileName = fileDate + '-ACG-DynamoScriptUsage.txt'
#get the path of the stats folder
statFilePath = dynamoFolderPath + "\\05-UsageStats\\" + fileName

# WRITE THE DATA
file = open(statFilePath,'a')
file.write(data)
file.close()
    
OUT = "Success! Run logged!"
# ----------------------------------------
result = Output(python_script)
