# Dynamo custom node Elements_AllElementsOfFamilyType.dyf "Elements.All Elements Of Family Type" (Dynamo 2.17.1.4055)
# category: ACG Tools
# Collects ann instance of a given family type (works for System families as well)

family_type = Input(family_type: var[]..[])
list_create = List.Create(item0=family_type)
flatten = List.Flatten(list=list_create)
code_block = CodeBlock { true; }
python_script = Python(IN[0]=flatten, IN[1]=code_block)  # IronPython2
# ---------- python_script.python (26 lines) ----------
import System
import clr
clr.AddReference('RevitAPI')
from Autodesk.Revit.DB import *

clr.AddReference("RevitServices")
import RevitServices
from RevitServices.Persistence import DocumentManager

doc = DocumentManager.Instance.CurrentDBDocument
famtypes = UnwrapElement(IN[0])

elementlist = list()
for ft in famtypes:
	collector = FilteredElementCollector(doc)
	bic = System.Enum.ToObject(BuiltInCategory, ft.Category.Id.IntegerValue)
	collector.OfCategory(bic)
	# This is a workaround
	# because I was to lazy to learn
	# how to implement LINQ in Python
	ftlist =  list()
	for item in collector.ToElements():
		if item.GetTypeId().IntegerValue == ft.Id.IntegerValue:
			ftlist.append(item)
	elementlist.append(ftlist)
OUT = elementlist
# ----------------------------------------

# group: Processing
# note: ReturnListOrSingleValue
python_script_2 = Python(IN[0]=flatten, IN[1]=python_script)  # IronPython2
# ---------- python_script_2.python (4 lines) ----------
check = IN[0]
items = IN[1]
if isinstance(check, (list)): OUT = items
else: OUT = items[0]
# ----------------------------------------

elements = Output(python_script_2)
