# Dynamo custom node Elements_GetInserts.dyf "Elements.Get Inserts" (Dynamo 2.17.1.4055)
# category: ACG Tools
# Collects all interted elements (doors, windows) from a host. From Clockworks

elements = Input(elements: var[]..[])
include_openings = Input(include_openings: bool = false)
include_shadows = Input(include_shadows: bool = false)
include_embedded_walls = Input(include_embedded_walls: bool = false)
include_shared_embedded_inserts = Input(include_shared_embedded_inserts: bool = false)
python_script = Python(IN[0]=elements, IN[1]=include_openings, IN[2]=include_shadows, IN[3]=include_embedded_walls, IN[4]=include_shared_embedded_inserts)  # IronPython2
# ---------- python_script.python (25 lines) ----------
import clr
clr.AddReference('RevitAPI')
from Autodesk.Revit.DB import *

clr.AddReference("RevitNodes")
import Revit
clr.ImportExtensions(Revit.Elements)

items = UnwrapElement(IN[0])
incopenings = IN[1]
incshadows = IN[2]
incwalls = IN[3]
incshared = IN[4]

def GetInserts(item,incopenings,incshadows,incwalls,incshared):
	# Regular host objects
	if hasattr(item, "FindInserts"):
		return [item.Document.GetElement(x) for x in item.FindInserts(incopenings,incshadows,incwalls,incshared)]
	# Railings
	elif hasattr(item, "GetAssociatedRailings"):
		return [item.Document.GetElement(x) for x in item.GetAssociatedRailings()]
	else: return []

if isinstance(IN[0], list): OUT = [GetInserts(x,incopenings,incshadows,incwalls,incshared) for x in items]
else: OUT = GetInserts(items,incopenings,incshadows,incwalls,incshared)
# ----------------------------------------
inserts = Output(python_script)
