# Dynamo custom node Elements_GetType.dyf "Elements.Get Types" (Dynamo 2.17.1.4055)
# category: ACG Tools
# Gets types from given elements, including linked elements too. Taken from Clockworks

elements = Input(elements: var[]..[])
list_create = List.Create(item0=elements)
flatten = List.Flatten(list=list_create)
python_script = Python(IN[0]=flatten)  # IronPython2
# ---------- python_script.python (12 lines) ----------
import clr
clr.AddReference('RevitAPI')
from Autodesk.Revit.DB import *

items = UnwrapElement(IN[0])
typelist = list()
for item in items:
	try: 
		typelist.append(item.Document.GetElement(item.GetTypeId()))
	except:
		typelist.append(None)
OUT = typelist
# ----------------------------------------

# group: Processing
# note: ReturnListOrSingleValue
python_script_2 = Python(IN[0]=flatten, IN[1]=python_script)  # IronPython2
# ---------- python_script_2.python (4 lines) ----------
check = IN[0]
items = IN[1]
if isinstance(check, (list)): OUT = items
else: OUT = items[0]
# ----------------------------------------

type = Output(python_script_2)
