# Dynamo custom node File_GetParentDirectory.dyf "File.Get Parent Directory" (Dynamo 2.12.1.8246)
# category: ACG Tools
# Returns the parent folder of a given file or folder

path = Input(path: string = null)  # File or folder path
index_up = Input(index_up: int = 0)  # Number of levels up 0 = parent folder 1 = 1 level up from the parent folder etc.
python_script = Python(IN[0]=path, IN[1]=index_up)  # IronPython2
# ---------- python_script.python (14 lines) ----------
import clr
import os

path = IN[0]
indexUp = IN[1]

# get the individual folders
folders = path.Split("\\")
newFolders = folders[:(-indexUp - 1)]

# assemble the new path
newPath = "\\".join(newFolders)

OUT = newPath
# ----------------------------------------
folder_path = Output(python_script)
