# Dynamo custom node Group_FromElements.dyf "Groups.From Elements" (Dynamo 2.17.1.4055)
# category: ACG Tools
# Creates a model or a detail group from a list of elements

elements = Input(elements: var[]..[])  # List of elements to be grouped
list_create = List.Create(item0=elements)
code_block = CodeBlock(lst=list_create) { DSCore.List.Flatten(lst); }
group_name = Input(group_name: string)
python_script = Python(IN[0]=code_block, IN[1]=group_name)  # IronPython2
# ---------- python_script.python (37 lines) ----------
import clr
clr.AddReference('RevitAPI')
from Autodesk.Revit.DB import *
from System.Collections.Generic import *

clr.AddReference("RevitServices")
import RevitServices
from RevitServices.Persistence import DocumentManager
from RevitServices.Transactions import TransactionManager

doc = DocumentManager.Instance.CurrentDBDocument

input = IN[0]

ids, rejects = [], []

if isinstance(input, list):
    items = UnwrapElement(input)
else:
    items = [UnwrapElement(input)]

for i in items:
    try:
        ids.append(i.Id)
    except:
        rejects.append(i)
items = List[ElementId](ids)

TransactionManager.Instance.EnsureInTransaction(doc)
try:
    group = doc.Create.NewGroup(items)
    group.GroupType.Name = IN[1]
except:
    group = []
TransactionManager.Instance.TransactionTaskDone()

OUT = (group, rejects)
# ----------------------------------------
code_block_2 = CodeBlock(seq=python_script) { seq[0]; seq[1]; }
group = Output(code_block_2.out0)
ungroupable_elements = Output(code_block_2.out1)
