# Dynamo custom node Groups_AllInstancesOfType.dyf "Groups.All Instances Of Type" (Dynamo 2.17.1.4055)
# category: ACG Tools
# Collects all instances of a given group type

group_type = Input(group_type: var[]..[])
# note: From Clockworks
python_script = Python(IN[0]=group_type)  # IronPython2
# ---------- python_script.python (27 lines) ----------
import clr
clr.AddReference('RevitAPI')
from Autodesk.Revit.DB import *

clr.AddReference("RevitNodes")
import Revit
clr.ImportExtensions(Revit.Elements)

input = IN[0]

if isinstance(input, list):
    g_types = UnwrapElement(input)
else:
    g_types = [UnwrapElement(input)]



element_list = []
for g_t in g_types:
	if g_t.GetType().ToString() == "Autodesk.Revit.DB.GroupType":
		groups = g_t.Groups
		g_list = []
		for group in groups:
			g_list.append(group.ToDSType(True))
		element_list.append(g_list)
	else: elementlist.append([])
OUT = element_list
# ----------------------------------------

# group: Processing
# note: ReturnListOrSingleValue
python_script_2 = Python(IN[0]=group_type, IN[1]=python_script)  # IronPython2
# ---------- python_script_2.python (4 lines) ----------
check = IN[0]
items = IN[1]
if isinstance(check, (list)): OUT = items
else: OUT = items[0]
# ----------------------------------------

group_instances = Output(python_script_2)
