# Dynamo custom node List_MatchWithKeyValue.dyf "List.Match With Key Value" (Dynamo 2.6.1.8786)
# category: ACG Tools

seq = Input(seq: var[]..[])

# group: To Revit
create = List.Create(item0=seq)
# note: TurnIntoList
flatten = List.Flatten(list=create)

keys = Input(keys: var[]..[])

# group: To Revit
create_2 = List.Create(item0=keys)
# note: TurnIntoList
flatten_2 = List.Flatten(list=create_2)

values = Input(values: var[]..[])

# group: To Revit
create_3 = List.Create(item0=values)
# note: TurnIntoList
flatten_3 = List.Flatten(list=create_3)

# note: List.MatchWithKeyValues
python_script = Python(IN[0]=flatten, IN[1]=flatten_2, IN[2]=flatten_3)
# ---------- python_script.python (17 lines) ----------
import clr

items = IN[0]
keys = IN[1]
values = IN[2]
elementlist = list()
for item in items:
	counter = 0
	hasmatch = False
	for key in keys:
		if (item == key):
			elementlist.append(values[counter])
			hasmatch = True
		counter += 1
	if hasmatch == False:
		elementlist.append(None)
OUT = elementlist
# ----------------------------------------
seq_2 = Output(python_script)  # "seq"
