# Dynamo custom node QuickAudit_InPlaceFamiliesCheck.dyf "Quick Audit.InPlace Families Check" (Dynamo 2.12.1.8246)
# category: ACG Tools

python_script = Python()  # IronPython2
# ---------- python_script.python (43 lines) ----------
# Load the Python Standard and DesignScript Libraries
import clr
import sys
sys.path.append('C:\Program Files (x86)\IronPython 2.7\Lib')
import System
from System import Array
from System.Collections.Generic import *
clr.AddReference('ProtoGeometry')
from Autodesk.DesignScript.Geometry import *
clr.AddReference("RevitNodes")
import Revit
clr.ImportExtensions(Revit.Elements)
clr.ImportExtensions(Revit.GeometryConversion)
clr.AddReference("RevitServices")
import RevitServices
from RevitServices.Persistence import DocumentManager 
from RevitServices.Transactions import TransactionManager 

clr.AddReference("RevitAPI")
clr.AddReference("RevitAPIUI")

import Autodesk 
from Autodesk.Revit.DB import *
from Autodesk.Revit.UI import *

doc = DocumentManager.Instance.CurrentDBDocument
uiapp = DocumentManager.Instance.CurrentUIApplication 
app = uiapp.Application 
uidoc = uiapp.ActiveUIDocument

lst = []

# collect all elements to be processed
famCol = FilteredElementCollector(doc).OfClass(Family).ToElements()

count = 0
for fam in famCol:
	if fam.IsInPlace:
		lst.append(fam.Name)
		count += 1


OUT = [lst, count]
# ----------------------------------------
code_block = CodeBlock(x=python_script) { x[0]; x[1]; }
Result = Output(code_block.out1)  # "*Result"
ListOfInPlaceFamilies = Output(code_block.out0)  # "*ListOfInPlaceFamilies"
