# Dynamo custom node QuickAudit_LevelsAndGridsCheck.dyf "Quick Audit.Levels And Grids Check" (Dynamo 2.17.1.4055)
# category: ACG Tools

# group: Input
code_block = CodeBlock()
# ---------- code_block.designscript (4 lines) ----------
[
"Levels",
"Grids"
];
# ----------------------------------------
byName = Category.ByName(name=code_block)
all_elements_of_category = ElementsOfCategory(Category=byName)

# group: Processing
isPinned = Element.IsPinned(element=all_elements_of_category)
filterByBoolMask = List.FilterByBoolMask(list=all_elements_of_category, mask=isPinned)

# group: Processing
code_block_2 = CodeBlock { "Workset"; "Shared_Levels_Grids"; }
parameterByName = Parameter.ParameterByName(element=all_elements_of_category, name=code_block_2.out0)
string_from_object = FromObject(object=parameterByName)
contains = String.Contains(string=string_from_object, searchFor=code_block_2.out1)
filterByBoolMask_2 = List.FilterByBoolMask(list=all_elements_of_category, mask=contains)

code_block_3 = CodeBlock(failWorkset=filterByBoolMask_2.out) { failWorkset; levels=failWorkset[0]; }

# group: Control
code_block_4 = CodeBlock(lvl=code_block_3.levels) { lvl.Name; "SSL"; }
contains_2 = String.Contains(string=code_block_4.out0, searchFor=code_block_4.out1)
filterByBoolMask_3 = List.FilterByBoolMask(list=code_block_3.levels, mask=contains_2)

# group: Processing
code_block_5 = CodeBlock { "Workset"; "Levels"; }
parameterByName_2 = Parameter.ParameterByName(element=filterByBoolMask_3.in, name=code_block_5.out0)
string_from_object_2 = FromObject(object=parameterByName_2)
contains_3 = String.Contains(string=string_from_object_2, searchFor=code_block_5.out1)
filterByBoolMask_4 = List.FilterByBoolMask(list=code_block_3.levels, mask=contains_3)
setDifference = List.SetDifference(list1=code_block_3.failWorkset, list2=filterByBoolMask_4.in)

list_create = List.Create(item0=filterByBoolMask.out, item1=setDifference)
code_block_6 = CodeBlock(lst=list_create) { failAll=DSCore.List.Flatten(lst); failUnique=DSCore.List.UniqueItems(failAll); failCount=DSCore.List.Count(failUnique); }
code_block_7 = CodeBlock(lst=all_elements_of_category) { allEl=DSCore.List.Flatten(lst); allCount=DSCore.List.Count(allEl); }
code_block_8 = CodeBlock(nonComp=code_block_6.failCount, allCount=code_block_7.allCount) { nonComp/allCount*100; }
round = Math.Round(number=code_block_8)
Result_percent = Output(round)  # "_Result (percent)"
code_block_9 = CodeBlock(e=code_block_6.failUnique) { e.Name; }
isNull = Object.IsNull(object=code_block_9)
countFalse = List.CountFalse(list=isNull)
Levels_number = Output(countFalse)  # "_Levels (number)"
countTrue = List.CountTrue(list=isNull)
Grids_number = Output(countTrue)  # "_Grids (number)"
