# Dynamo custom node QuickAudit_RedundantRoomCheck.dyf "Quick Audit.Redundant Rooms Check" (Dynamo 2.12.1.8246)
# category: ACG Tools

python_script = Python()  # IronPython2
# ---------- python_script.python (20 lines) ----------
#Copyright (c) mostafa el ayoubi
#Node-mode 2016 elayoub.mostafa@gmail.com
import datetime
import os
import clr
clr.AddReference('RevitAPI')
from Autodesk.Revit.DB import*
clr.AddReference('RevitServices')
from RevitServices.Persistence import DocumentManager

doc = DocumentManager.Instance.CurrentDBDocument
path = doc.PathName
docname = path.encode('string-escape')


rooms = FilteredElementCollector(doc)\
.OfCategory(BuiltInCategory.OST_Rooms)\
.ToElements()

OUT = sum(1 for room in rooms if not room.Area > 0)
# ----------------------------------------
Result = Output(python_script)  # "*Result"
