# Dynamo custom node QuickAudit_RevisionCheck.dyf "Quick Audit.Revision Check" (Dynamo 2.17.1.4055)
# category: ACG Tools
# Checks if PRODUCTION sheets have no revision or if there are revisions assigned to WIP sheets

# group: Input - get all WIP & PROD sheets
python_script = Python()  # IronPython2; unwired: IN[0]
# ---------- python_script.python (40 lines) ----------
import clr
import sys
sys.path.append('C:\Program Files (x86)\IronPython 2.7\Lib')
import System
from System import Array
from System.Collections.Generic import *
clr.AddReference('ProtoGeometry')
from Autodesk.DesignScript.Geometry import *
clr.AddReference("RevitNodes")
import Revit
clr.ImportExtensions(Revit.Elements)
clr.ImportExtensions(Revit.GeometryConversion)
clr.AddReference("RevitServices")
import RevitServices
from RevitServices.Persistence import DocumentManager 
from RevitServices.Transactions import TransactionManager 

clr.AddReference("RevitAPI")
clr.AddReference("RevitAPIUI")

import Autodesk 
from Autodesk.Revit.DB import *
from Autodesk.Revit.UI import *

doc = DocumentManager.Instance.CurrentDBDocument
uiapp = DocumentManager.Instance.CurrentUIApplication 
app = uiapp.Application 
uidoc = uiapp.ActiveUIDocument

#######OK NOW YOU CAN CODE########
sheets = FilteredElementCollector(doc)\
.OfCategory(BuiltInCategory.OST_Sheets)\
.WhereElementIsNotElementType().ToElements()

wip = [s for s in sheets
if "WIP" in s.LookupParameter("Sheet Phase").AsString()]
prod = [s for s in sheets
if "PROD" in s.LookupParameter("Sheet Phase").AsString()]

OUT = wip, prod
# ----------------------------------------
code_block = CodeBlock(x=python_script) { WIPsheets = x[0]; PRODsheets = x[1]; }

# group: Process - check if the sheets have revisions
python_script_2 = Python(IN[0]=code_block.WIPsheets)  # IronPython2
# ---------- python_script_2.python (52 lines) ----------
import clr
import sys
sys.path.append('C:\Program Files (x86)\IronPython 2.7\Lib')
import System
from System import Array
from System.Collections.Generic import *
clr.AddReference('ProtoGeometry')
from Autodesk.DesignScript.Geometry import *
clr.AddReference("RevitNodes")
import Revit
clr.ImportExtensions(Revit.Elements)
clr.ImportExtensions(Revit.GeometryConversion)
clr.AddReference("RevitServices")
import RevitServices
from RevitServices.Persistence import DocumentManager 
from RevitServices.Transactions import TransactionManager 

clr.AddReference("RevitAPI")
clr.AddReference("RevitAPIUI")

import Autodesk 
from Autodesk.Revit.DB import *
from Autodesk.Revit.UI import *

doc = DocumentManager.Instance.CurrentDBDocument
uiapp = DocumentManager.Instance.CurrentUIApplication 
app = uiapp.Application 
uidoc = uiapp.ActiveUIDocument

#######OK NOW YOU CAN CODE########
input = IN[0]


# make sure the input is a LIST
if isinstance(input, list):
    sheets = UnwrapElement(input)
else:
    sheets = [UnwrapElement(input)]


# check for revisions
rev_yes, rev_no = [], []

for s in sheets:
    rev_ids = s.GetAllRevisionIds()
    if len(rev_ids) > 0:
        rev_yes.append(s)
    else:
        rev_no.append(s)


OUT = rev_yes, rev_no
# ----------------------------------------
code_block_2 = CodeBlock(x=python_script_2) { with_revision = x[0]; no_revision = x[1]; DSCore.List.Count(with_revision); }

# group: Process - check if the sheets have revisions
python_script_3 = Python(IN[0]=code_block.PRODsheets)  # IronPython2; same code as python_script_2
code_block_3 = CodeBlock(x=python_script_3) { with_revision = x[0]; no_revision = x[1]; DSCore.List.Count(no_revision); }

# group: Assing
code_block_4 = CodeBlock(WIP_count=code_block_2.out2, PROD_count=code_block_3.out2)
# ---------- code_block_4.designscript (8 lines) ----------
WIP_txt = "There are "+WIP_count+" sheets in WIP that have revision assigned, but are not moved to PRODUCTION.";
WIP_count == 0?"":WIP_txt;

PROD_txt = "There are "+PROD_count+" sheets in PRODUCTION that have no revision assigned, please move back to WIP.";
PROD_count == 0?"":PROD_txt;

ttl_count = WIP_count + PROD_count;
ttl_count == 0?"Excellent! All Revisions have been set up correctly" : WIP_txt+"\n"+PROD_txt;
# ----------------------------------------

# group: Process - get all the non-compliant sheet numbers
list_create = List.Create(item0=code_block_2.with_revision, item1=code_block_3.no_revision)
flatten = List.Flatten(list=list_create)
sheetNumber = Sheet.SheetNumber(sheet=flatten)

# group: Assing
Result = Output(code_block_4.out5)  # "*Result"
ListOfSheets = Output(sheetNumber)  # "*ListOfSheets"
