# Dynamo graph QuickAudit_ViewTemplateCheck.dyf "ACG Quick View Template Check" (Dynamo 2.0.3.8810)

# group: Floor Plans on sheets
code_block = CodeBlock { "Views"; }
byName = Category.ByName(name=code_block)
all_elements_of_category = ElementsOfCategory(Category=byName)
removeNulls = Lists.Manage.RemoveNulls(Data=all_elements_of_category)
code_block_2 = CodeBlock { "Sheet Number"; }
parameterByName = Parameter.ParameterByName(element=removeNulls.Cleaned, name=code_block_2)
string_from_object = FromObject(obj=parameterByName)
code_block_3 = CodeBlock { "---"; }
contains = String.Contains(str=string_from_object, searchFor=code_block_3)
filterByBoolMask = List.FilterByBoolMask(list=removeNulls.Cleaned, mask=contains)
code_block_4 = CodeBlock { "Sheet Number"; }
parameterByName_2 = Parameter.ParameterByName(element=filterByBoolMask.out, name=code_block_4)
string_from_object_2 = FromObject(obj=parameterByName_2)
code_block_5 = CodeBlock { "null"; }
contains_2 = String.Contains(str=string_from_object_2, searchFor=code_block_5)
filterByBoolMask_2 = List.FilterByBoolMask(list=filterByBoolMask.out, mask=contains_2)

name = Element.Name(element=filterByBoolMask_2.out)
code_block_6 = CodeBlock { "Sheet Number"; }
parameterByName_3 = Parameter.ParameterByName(element=filterByBoolMask_2.out, name=code_block_6)
string_from_object_3 = FromObject(obj=parameterByName_3)
code_block_7 = CodeBlock { 0; 15; }
remove = String.Remove(str=string_from_object_3, startIndex=code_block_7.out0, count=code_block_7.out1)
startsWith = String.StartsWith(str=name, searchFor=remove)
filterByBoolMask_3 = List.FilterByBoolMask(list=filterByBoolMask_2.out, mask=startsWith)
name_2 = Element.Name(element=filterByBoolMask_3.in)
code_block_8 = CodeBlock { 0; 5; }
remove_2 = String.Remove(str=name_2, startIndex=code_block_8.out0, count=code_block_8.out1)
code_block_9 = CodeBlock { ["XX-","ZZ-"]; }
code_block_10 = CodeBlock { "Levels"; "Grids"; }
byName_2 = Category.ByName(name=code_block_10.out0)
all_elements_of_category_2 = ElementsOfCategory(Category=byName_2)
name_3 = Element.Name(element=all_elements_of_category_2)
length = String.Length(str=name_3)
code_block_11 = CodeBlock { 2; }
eq = length == code_block_11
filterByBoolMask_4 = List.FilterByBoolMask(list=name_3, mask=eq)
code_block_12 = CodeBlock { 2; "-"; }
insert = String.Insert(str=filterByBoolMask_4.in, index=code_block_12.out0, toInsert=code_block_12.out1)
create = List.Create(item0=code_block_9, item1=insert)
flatten = List.Flatten(list=create)
startsWith_2 = String.StartsWith(str=remove_2@@L1, searchFor=flatten)
code_block_13 = CodeBlock { false; }
eq_2 = _ == code_block_13  # unwired: x
trueForAll = List.TrueForAll(list=startsWith_2@L2, predicate=eq_2)
list_filterbyboolmask_corectly = List.FilterByBoolMask(list=filterByBoolMask_3.in, mask=trueForAll)  # "List.FilterByBoolMask-Corectly/Incorrectly named views"
count_compliant = List.Count(list=list_filterbyboolmask_corectly.out)
select_model_health_bars_family = FamilyTypes(index=94)  # graph input
all_elements_of_family_type = ElementsOfFamilyType(Family_Type=select_model_health_bars_family)
code_block_14 = CodeBlock()
# ---------- code_block_14.designscript (12 lines) ----------
"Redundant Rooms";
"Redundant Areas";
"CAD Imports";
"Group Naming";
"Group Nesting";
"Family Naming";
"Levels & Grids";
"Sheet Naming";
"View Template Naming";
"View Template Usage";
"View Naming";
"Warnings";
# ----------------------------------------
acg_quick_cad_import_check = Custom[ACG Quick CAD Import Check]()
setParameterByName = Element.SetParameterByName(element=all_elements_of_family_type, parameterName=code_block_14.out2, value=acg_quick_cad_import_check)
acg_quick_redundant_room_check = Custom[ACG Quick Redundant Room Check]()
setParameterByName_2 = Element.SetParameterByName(element=all_elements_of_family_type, parameterName=code_block_14.out0, value=acg_quick_redundant_room_check)
acg_quick_redundant_area_check = Custom[ACG Quick Redundant Area Check]()
setParameterByName_3 = Element.SetParameterByName(element=all_elements_of_family_type, parameterName=code_block_14.out1, value=acg_quick_redundant_area_check)
get_all_detail_groups = Custom[Get All Detail Groups]()  # This node will retrieve all instances of Detail Groups in the model.
uniqueItems = List.UniqueItems(list=get_all_detail_groups.Group_Names)
typeCollector = Custom[ModelGroup.TypeCollector]()  # Returns all the types (not instances) from all model groups in the project
name_4 = Element.Name(element=typeCollector)
uniqueItems_2 = List.UniqueItems(list=name_4)
create_2 = List.Create(item0=uniqueItems, item1=uniqueItems_2)
flatten_2 = List.Flatten(list=create_2)
uniqueItems_3 = List.UniqueItems(list=flatten_2)
code_block_15 = CodeBlock { "ACG-"; }
startsWith_3 = String.StartsWith(str=uniqueItems_3, searchFor=code_block_15)
filterByBoolMask_5 = List.FilterByBoolMask(list=uniqueItems_3, mask=startsWith_3)
code_block_16 = CodeBlock { 0; 8; }
remove_3 = String.Remove(str=filterByBoolMask_5.in, startIndex=code_block_16.out0, count=code_block_16.out1)
code_block_17 = CodeBlock { "-"; }
startsWith_4 = String.StartsWith(str=remove_3, searchFor=code_block_17)
filterByBoolMask_6 = List.FilterByBoolMask(list=filterByBoolMask_5.in, mask=startsWith_4)
list_create = List.Create(item0=filterByBoolMask_6.out, item1=filterByBoolMask_5.out)
flatten_3 = List.Flatten(list=list_create)
uniqueItems_4 = List.UniqueItems(list=flatten_3)
count_incompliant = List.Count(list=uniqueItems_4)
count_compliant_2 = List.Count(list=filterByBoolMask_6.in)
code_block_18 = CodeBlock(incompliant=count_incompliant, compliant=count_compliant_2) { incompliant/(compliant+incompliant)*100; }
round = Math.Round(number=code_block_18)
setParameterByName_4 = Element.SetParameterByName(element=all_elements_of_family_type, parameterName=code_block_14.out3, value=round)
acg_quick_groups_check = Custom[ACG Quick Groups Check]()
setParameterByName_5 = Element.SetParameterByName(element=all_elements_of_family_type, parameterName=code_block_14.out4, value=acg_quick_groups_check.Results_Nesting)
number = DoubleInput(4)
acg_quick_sheet_naming_check = Custom[ACG Quick Sheet Naming Check](Number_Of_Digits=number)
setParameterByName_6 = Element.SetParameterByName(element=all_elements_of_family_type, parameterName=code_block_14.out7, value=acg_quick_sheet_naming_check.Results)
acg_quick_family_naming_check = Custom[ACG Quick Family Naming Check]()
setParameterByName_7 = Element.SetParameterByName(element=all_elements_of_family_type, parameterName=code_block_14.out5, value=acg_quick_family_naming_check.Results_Naming)
create_3 = List.Create(item0=filterByBoolMask_3.out, item1=list_filterbyboolmask_corectly.in)
flatten_4 = List.Flatten(list=create_3)
count_non_compliant = List.Count(list=flatten_4)
count_total = List.Count(list=filterByBoolMask_2.out)
code_block_19 = CodeBlock(incompliant=count_non_compliant, total=count_total) { incompliant/total*100; }
round_2 = Math.Round(number=code_block_19)
setParameterByName_8 = Element.SetParameterByName(element=all_elements_of_family_type, parameterName=code_block_14.out10, value=round_2)
view_type = ViewTypesUi(index=23)
getByType = archilab.Revit.Views.Views.GetByType(viewType=view_type.out0)
count_total_2 = List.Count(list=getByType)
name_5 = Element.Name(element=getByType)
code_block_20 = CodeBlock { "ACG-"; }
startsWith_5 = String.StartsWith(str=name_5, searchFor=code_block_20)
filterByBoolMask_7 = List.FilterByBoolMask(list=name_5, mask=startsWith_5)
code_block_21 = CodeBlock { 0; 8; "-"; }
remove_4 = String.Remove(str=filterByBoolMask_7.in, startIndex=code_block_21.out0, count=code_block_21.out1)
startsWith_6 = String.StartsWith(str=remove_4, searchFor=code_block_21.out2)
filterByBoolMask_8 = List.FilterByBoolMask(list=filterByBoolMask_7.in, mask=startsWith_6)
count_compliant_3 = List.Count(list=filterByBoolMask_8.in)
code_block_22 = CodeBlock(total=count_total_2, compliant=count_compliant_3) { (total-compliant)/total*100; }
# note: Result Naming
round_3 = Custom[Math.Round+](dbl=code_block_22)  # Rounds a number to a specified precision
setParameterByName_9 = Element.SetParameterByName(element=all_elements_of_family_type, parameterName=code_block_14.out8, value=round_3)
code_block_23 = CodeBlock { true; }
getAll = Custom[View.GetAll](toggle=code_block_23)  # Gets all views except for view templates
viewTemplate = archilab.Revit.Views.Views.ViewTemplate(view=getAll)
uniqueItems_5 = List.UniqueItems(list=viewTemplate)
isNull = Object.IsNull(obj=uniqueItems_5)
filterByBoolMask_9 = List.FilterByBoolMask(list=uniqueItems_5, mask=isNull)
setDifference = List.SetDifference(list1=getByType, list2=filterByBoolMask_9.out)
count_incompliant_2 = List.Count(list=setDifference)
code_block_24 = CodeBlock(incompliant=count_incompliant_2, total=count_total_2) { incompliant/total*100; }
# note: Result Usage
round_4 = Custom[Math.Round+](dbl=code_block_24)
setParameterByName_10 = Element.SetParameterByName(element=all_elements_of_family_type, parameterName=code_block_14.out9, value=round_4)
byName_3 = Category.ByName(name=code_block_10.out1)

# group: Collect all grids
all_elements_of_category_3 = ElementsOfCategory(Category=byName_3)

# group: Checks if grids are in the correct workset
code_block_25 = CodeBlock { "Workset"; }
parameterByName_4 = Parameter.ParameterByName(element=all_elements_of_category_3, name=code_block_25)
string_from_object_4 = FromObject(obj=parameterByName_4)
code_block_26 = CodeBlock { "Shared_Levels_Grids"; }
contains_3 = String.Contains(str=string_from_object_4, searchFor=code_block_26)
filterByBoolMask_10 = List.FilterByBoolMask(list=all_elements_of_category_3, mask=contains_3)
element_name_iincorrect = Element.Name(element=filterByBoolMask_10.out)

python_script = Python(IN[0]=all_elements_of_category_3)
# ---------- python_script.python (28 lines) ----------
import clr
clr.AddReference('RevitAPI')
import Autodesk
from Autodesk.Revit.DB import *

clr.AddReference("RevitNodes")
import Revit
clr.ImportExtensions(Revit.Elements)

clr.AddReference("RevitServices")
import RevitServices
from RevitServices.Persistence import DocumentManager
from RevitServices.Transactions import TransactionManager

from operator import itemgetter

from System.Collections.Generic import *

doc = DocumentManager.Instance.CurrentDBDocument

elements = UnwrapElement(IN[0])
output = []

for element in elements:
	output.append(element.Pinned)

#Assign your output to the OUT variable.
OUT = output
# ----------------------------------------
filterByBoolMask_11 = List.FilterByBoolMask(list=all_elements_of_category_3, mask=python_script)
element_name_incorrect = Element.Name(element=filterByBoolMask_11.out)
list_create_2 = List.Create(item0=element_name_iincorrect, item1=element_name_incorrect)
flatten_5 = List.Flatten(list=list_create_2)
uniqueItems_6 = List.UniqueItems(list=flatten_5)
count_non_compliant_2 = List.Count(list=uniqueItems_6)

# group: Collect all levels
all_elements_of_category_4 = ElementsOfCategory(Category=byName_2)

# group: Checks if levels are in the correct workset
code_block_27 = CodeBlock { "Workset"; }
parameterByName_5 = Parameter.ParameterByName(element=all_elements_of_category_4, name=code_block_27)
string_from_object_5 = FromObject(obj=parameterByName_5)
code_block_28 = CodeBlock { "Shared_Levels_Grids"; }
contains_4 = String.Contains(str=string_from_object_5, searchFor=code_block_28)
filterByBoolMask_12 = List.FilterByBoolMask(list=all_elements_of_category_4, mask=contains_4)
element_name_incorrect_2 = Element.Name(element=filterByBoolMask_12.out)

python_script_2 = Python(IN[0]=all_elements_of_category_4)  # same code as python_script
filterByBoolMask_13 = List.FilterByBoolMask(list=all_elements_of_category_4, mask=python_script_2)
name_6 = Element.Name(element=filterByBoolMask_13.out)
list_create_3 = List.Create(item0=element_name_incorrect_2, item1=name_6)
flatten_6 = List.Flatten(list=list_create_3)
uniqueItems_7 = List.UniqueItems(list=flatten_6)
count_non_compliant_3 = List.Count(list=uniqueItems_7)
count_total_grids = List.Count(list=all_elements_of_category_3)
count_total_levels = List.Count(list=all_elements_of_category_4)
total_non_compliant = CodeBlock(noncompgrids=count_non_compliant_2, noncomplevels=count_non_compliant_3, totalgrids=count_total_grids, totallevels=count_total_levels) { (noncompgrids+noncomplevels)/(totalgrids+totallevels)*100; }
round_5 = Math.Round(number=total_non_compliant)
setParameterByName_11 = Element.SetParameterByName(element=all_elements_of_family_type, parameterName=code_block_14.out6, value=round_5)
code_block_29 = CodeBlock { "Project Information"; }
byName_4 = Category.ByName(name=code_block_29)
all_elements_of_category_5 = ElementsOfCategory(Category=byName_4)
code_block_30 = CodeBlock { "Project Directory"; }
getParameterValueByName = Element.GetParameterValueByName(element=all_elements_of_category_5, parameterName=code_block_30)
string = StringInput("\")
code_block_31 = CodeBlock { "08 Audit"; }
today = DateTime.Today()
string_from_object_6 = FromObject(obj=today)
code_block_32 = CodeBlock { " "; "/"; }
split = String.Split(str=string_from_object_6, separater0=code_block_32.out0)
code_block_33 = CodeBlock(x=split) { x[0]; }
split_2 = String.Split(str=code_block_33, separater0=code_block_32.out1)
code_block_34 = CodeBlock(x=split_2) { x[0]; x[1]; x[2]; }
code_block_35 = CodeBlock(prjdirectory=getParameterValueByName, sign=string, auditfolder=code_block_31, year=code_block_34.out2, month=code_block_34.out1, day=code_block_34.out0) { prjdirectory+sign+auditfolder+sign+year+month+day+"QuickAuditResults.csv"; }
string_from_object_7 = FromObject(obj=code_block_35)
code_block_36 = CodeBlock { "test"; ","; }
code_block_37 = CodeBlock { true; }
getWarnings = Bang.Revit.Elements.WarningTools.GetWarnings(toggle=code_block_37)
count = List.Count(list=getWarnings.Warning_Text)
list_create_4 = List.Create(item0=count, item1=acg_quick_cad_import_check, item2=acg_quick_redundant_room_check, item3=acg_quick_redundant_area_check, item4=round, item5=acg_quick_groups_check.Results_Nesting, item6=acg_quick_family_naming_check.Results_Naming, item7=acg_quick_sheet_naming_check.Results, item8=round_2, item9=round_3, item10=round_4, item11=round_5)
string_from_object_8 = FromObject(obj=list_create_4)
code_block_38 = CodeBlock { "NaN"; "0"; }
replace = String.Replace(str=string_from_object_8, searchFor=code_block_38.out0, replaceWith=code_block_38.out1)
code_block_39 = CodeBlock { ".000000"; ""; }
replace_2 = String.Replace(str=replace, searchFor=code_block_39.out0, replaceWith=code_block_39.out1)
writeToCSV = Custom[File.WriteToCSV](path=string_from_object_7, delimiter=code_block_36.out1, data=replace_2)  # Writes data to a CSV file with a custom delimiter. Data inputs needs to contain strings only!
setParameterByName_12 = Element.SetParameterByName(element=all_elements_of_family_type, parameterName=code_block_14.out11, value=count)
