# Dynamo custom node Room_RenameByContent.dyf "Room.Rename By Content" (Dynamo 1.3.3.4111)
# category: ACG Tools
# Renames a room by a family that is placed inside

all = Orchid.Revit.Elements.Family.All()
flatten = Flatten(all)
string_from_object = FromObject(flatten)

# group: Input
Search_for_family = Input()  # ""Search for family""
Room_name = Input()  # ""Room name""

code_block = CodeBlock { false; }
contains = String.Contains(str=string_from_object, searchFor=Search_for_family, ignoreCase=code_block)
filterByBoolMask = List.FilterByBoolMask(list=flatten, mask=contains)
elementByFamily = Orchid.Revit.Elements.Selection.ElementByFamily(filterByBoolMask.in)
room = Rhythm.Revit.Elements.FamilyInstances.Room(elementByFamily)
code_block_2 = CodeBlock { "Name"; }
setParameterByNameTypeOrInstance = Rhythm.Revit.Elements.Elements.SetParameterByNameTypeOrInstance(room, code_block_2, Room_name)
Element = Output(setParameterByNameTypeOrInstance)  # ""Element""
