# Dynamo custom node Selection_AllElementsByCategoryName.dyf "Selection.All Elements By Category Name" (Dynamo 2.17.1.4055)
# category: ACG Tools
# Collects all elements of a given category name.

category_name = Input(category_name: string = null)  # The name of the category as string.
code_block = CodeBlock(input=category_name) { Revit.Category.ByName(input); }
code_block_2 = CodeBlock(cat=code_block) { ElementQueries.OfCategory(cat); }
elements = Output(code_block_2)
