# Dynamo custom node Selection_AllElementsByTypeName.dyf "Selection.All Elements By Type Name" (Dynamo 2.17.1.4055)
# category: ACG Tools
# Collects all elements of a given type name.

type_name = Input(type_name: string = null)  # The name of the type as string
code_block = CodeBlock(input=type_name) { DSCore.Types.FindTypeByNameInAssembly(input,"RevitAPI"); }
all_elements_of_type = ElementsOfType(element_type=code_block)
elements = Output(all_elements_of_type)
