# Dynamo custom node Selection_SelectModelElementsFromCategory.dyf "Selection.Select Model Elements From Category" (Dynamo 2.17.1.4055)
# category: ACG Tools
# Taken from Rhythm - IsolatedPickModelElements and updated.

refresh = Input(refresh: bool = false)
category = Input(category: string)  # Name of the category as string
string_from_object = FromObject(object=category)
cancel = Input(cancel: bool = false)
python_script = Python(IN[0]=refresh, IN[1]=string_from_object, IN[2]=cancel)  # IronPython2
# ---------- python_script.python (43 lines) ----------
#Copyright(c) 2017, john pierson
# @60secondrevit, http://sixtysecondrevit.com
#Sometimes a pick selection is better
#Based on a node from Dimitar Venkov

import clr
clr.AddReference("RevitAPIUI")
from  Autodesk.Revit.UI import *
clr.AddReference("RevitServices")
import RevitServices
from RevitServices.Persistence import DocumentManager
doc = DocumentManager.Instance.CurrentDBDocument
uidoc=DocumentManager.Instance.CurrentUIApplication.ActiveUIDocument
clr.AddReference("RevitNodes")
import Revit
clr.ImportExtensions(Revit.Elements)

if IN[2] == False:

	TaskDialog.Show('Isolated Selection','Pick elements of category, ' + (IN[1].lower()) + '. Press finish to complete.')

	sel1 = uidoc.Selection
	obt1 = Selection.ObjectType.Element
	class CustomISelectionFilter(Selection.ISelectionFilter):
		def __init__(self, nom_categorie):
			self.nom_categorie = nom_categorie
		def AllowElement(self, e):
			if e.Category.Name == self.nom_categorie:
				return True
			else:
				return False
		def AllowReference(self, ref, point):
			return true
		
	el_ref = sel1.PickObjects(obt1, CustomISelectionFilter(IN[1]), 'Pick elements of category, ' + (IN[1].lower()) + ' Press finish to complete.')
	typelist = list()
	idlist = list()
	for i in el_ref:
		try:
			typelist.append(doc.GetElement(i.ElementId))
		except:
			typelist.apped(list())
	OUT = typelist
# ----------------------------------------
elements = Output(python_script)
