# Dynamo custom node Views_DisableTemporarylyHideIsolate.dyf "Views.Disable Temporary View Settings" (Dynamo 2.17.1.4055)
# category: ACG Tools
# Disables the temporary hide and isolate settings on a given list of views.

views = Input(views: var[]..[])  # List of views to be processed
python_script = Python(IN[0]=views)  # IronPython2
# ---------- python_script.python (36 lines) ----------
import clr
clr.AddReference('RevitAPI')
from Autodesk.Revit.DB import *

clr.AddReference("RevitServices")
import RevitServices
from RevitServices.Persistence import DocumentManager
from RevitServices.Transactions import TransactionManager

doc = DocumentManager.Instance.CurrentDBDocument
input = IN[0]

if isinstance(input, list):
    views = UnwrapElement(input)
else:
    views = [UnwrapElement(input)]

count_pass = 0
views_pass = []

TransactionManager.Instance.EnsureInTransaction(doc)

for view in views:
    try:
        if view.IsTemporaryHideIsolateActive() == True:
            view.DisableTemporaryViewMode(TemporaryViewMode.TemporaryHideIsolate)
            count_pass += 1
            views_pass.append(view.Name)
    except:
        continue
TransactionManager.Instance.TransactionTaskDone()

if count_pass == 0:
    OUT = ["Fail", []]
else:
    OUT = ["Success", views_pass]
# ----------------------------------------
code_block = CodeBlock(x=python_script) { x[0]; x[1]; }
success = Output(code_block.out0)
list_views = Output(code_block.out1)
