# Dynamo custom node Walls_GetOrientation.dyf "Walls.Get Orientation" (Dynamo 2.17.1.4055)
# category: ACG Tools
# From Rhythm 2017. Gets the world orientation of a wall - south, north, east or west.

wall = Input(wall: var[]..[])
normals = Input(normals: var[]..[])
X = Point.X(point=normals)
Y = Point.Y(point=normals)
code_block = CodeBlock(x=X, y=Y) { x; y; x<=0.708&&x>=-0.707; y<=1&&y>=0.707; }
code_block_2 = CodeBlock(a=code_block.out2, b=code_block.out3) { a&&b; }
filterByBoolMask = List.FilterByBoolMask(list=wall, mask=code_block_2)
north = Output(filterByBoolMask.in)
code_block_3 = CodeBlock(x=X, y=Y) { x; y; x<=1&&x>=0.708; y<=0.706&&y>=-0.707; }
code_block_4 = CodeBlock(a=code_block_3.out2, b=code_block_3.out3) { a&&b; }
filterByBoolMask_2 = List.FilterByBoolMask(list=wall, mask=code_block_4)
east = Output(filterByBoolMask_2.in)
code_block_5 = CodeBlock(x=X, y=Y) { x; y; x<=-0.707&&x>=-1; y<=0.708&&y>=-0.706; }
code_block_6 = CodeBlock(a=code_block_5.out2, b=code_block_5.out3) { a&&b; }
filterByBoolMask_3 = List.FilterByBoolMask(list=wall, mask=code_block_6)
west = Output(filterByBoolMask_3.in)
code_block_7 = CodeBlock(x=X, y=Y) { x; y; x<=0.708&&x>-0.708; y<=-0.707&&y>=-1; }
code_block_8 = CodeBlock(a=code_block_7.out2, b=code_block_7.out3) { a&&b; }
filterByBoolMask_4 = List.FilterByBoolMask(list=wall, mask=code_block_8)
south = Output(filterByBoolMask_4.in)
